vi "ApplySmokeCalApproximation.gvi"   [LabVIEW NXG 4.0.0]
# This Vi will take the measured Zero Cal values and apply a multiplication factor (2.2) to the smoke Cal locations in EEPROM. in doing this it negates the necessity to perform smoke calibrations for samples.
inputs:
  "session in": "VISA Instr"
  "error in": error
  "ZeroCalIn": u8[]
  "ApplySmokeCalApproximation": bool
  "SmokeMultiplyFactor": f64 = 2.2
outputs:
  "session out": "VISA Instr"
  "error out": error
  "Smoke Cal Values": u8[]
uses:
  600SeriesTestEnvironment::CRC.gvi
  NI::VISA::Write (Instr, Bytes).gvi
  NI::VISA::Read (Instr, Bytes).gvi
  NI::G Core::Error::Clear Error Cluster.gvi
diagram:
  case ($ApplySmokeCalApproximation) {
    frame False, Default {
      w1 = $"error in"
      w2 = $"session in"
    }
    frame True {
      Multiply($ZeroCalIn, $SmokeMultiplyFactor) -> w3: u32[]
      To Unsigned 8 Bit Integer(number=w3) -> w4
      Split 1D Array(array=w4, index=1) -> (first subarray=w5, second subarray=w6)
      Build Array([0, 85, 13, 60, 40, 8], w5, w5, w5, 0, w6, w6, w6, 0) -> w7
      Array Subset(array=w7, index0=3) -> w8
      call "CRC.gvi"(Input for CRC Calculation=w8) -> (MSB=w9, LSB=w10)
      Build Array(w7, w9, w10) -> w11
      call "Write (Instr, Bytes).gvi"(session in=$"session in", error in=$"error in", write buffer=w11) -> (session out=w12, error out=w13)
      call "Read (Instr, Bytes).gvi"(session in=w12, error in=w13, byte count=20) -> (session out=w2, error out=w14, read buffer=w15)
      call "Clear Error Cluster.gvi"(error in=w14) -> (error out=w1)
      Array Index(array=w15) -> (out0[3]=w16)
      case (w16) {
        frame 62, Default {
          Array Index(array=w15) -> (out0[6]=w18)
          Array Index(array=w15) -> (out0[10]=w19)
          Build Array(w18, w19) -> w17
        }
        frame 63 {
          w17 = default
        }
      }
      $"Smoke Cal Values" <- w17
    }
  }
  $"session out" <- w2
  $"error out" <- w1
