vi "BuildExtendedMessage.gvi"   [LabVIEW NXG 4.0.0]
inputs:
  "S1": string
  "S2": string
  "S3": string
  "S4": string
  "Com/Req": string
  "Code": string
outputs:
  "RF Input String": string
diagram:
  Concatenate Strings("*extend", ",", "ED", ",", "C0", ",", "F0", ",", $S1, ",", $S2, ",", $S3, ",", $S4, ",", $"Com/Req", ",", $Code) -> w1
  Concatenate Strings(w1, "\r", "\r\n") -> w2
  $"RF Input String" <- w2
