vi "CRC.gvi"   [LabVIEW NXG 4.0.0]
# This VI is used to calculate the CRC of both incoming and outgoing messages from Ei products using UART. the CRC used is the CCITT-16 standard.
inputs:
  "Input for CRC Calculation": u8[]
outputs:
  "MSB": u16
  "LSB": u16
uses:
  600SeriesTestEnvironment::CRC-CCITT-16.gvi
diagram:
  s1 = uninitialised  # shift register
  s2 = uninitialised  # shift register
  for (iteration -> i1) {
    w1 = each element of $"Input for CRC Calculation"
    Is Equal To 0(x=i1) -> w2
    call "CRC-CCITT-16.gvi"(CRC-CCITT Type="CRC-16-CCITT (0xFFFF)"(65535), Reset=w2, CRC In=s2, Data=w1, error in (no error)=s1) -> (CRC=w3, error out=w4)
    next s1 = w4
    next s2 = w3
  }
  Logical Shift(x=s2, y=-8) -> w5
  $MSB <- w5
  Logical And(s2, 255) -> w6
  $LSB <- w6
