vi "CaptureSmokeCal.gvi"   [LabVIEW NXG 4.0.0]
inputs:
  "Input_2": error
  "Input": "VISA Instr"
outputs:
  "session out": "VISA Instr"
  "error out": error
  "SmokeCalForGraph": u16[]
panel indicators:
  "appended array": i32[]
  "Bytes at Port": u32
  "subarray": u8[]
  "subarray_2": u8[]
  "sum": u16
uses:
  600SeriesTestEnvironment::CRC.gvi
  NI::VISA::Write (Instr, Bytes).gvi
  NI::VISA::Read (Instr, Bytes).gvi
  NI::VISA::Flush Buffer (Instr).gvi
diagram:
  Build Array([62], [16], [16]) -> w1
  call "CRC.gvi"(Input for CRC Calculation=w1) -> (MSB=w2, LSB=w3)
  Build Array(w1, w2, w3) -> w4
  Array Size(array=w4) -> (size(s)=w5)
  Build Array([0, 85], w5, w4) -> w6
  call "Write (Instr, Bytes).gvi"(session in=$Input, error in=$Input_2, write buffer=w6) -> (session out=w7, error out=w8)
  case (TRUE) {
    frame False, Default {
      w9 = default
      w10 = default
    }
    frame True {
      Wait(time to wait=100)
      w9 = w8
      w10 = w7
    }
  }
  Property Node(instance in=w10, error in=w9) -> ("ASRL Bytes at Port"=w11, error out=w12, instance out=w13)
  call "Read (Instr, Bytes).gvi"(session in=w13, error in=w12, byte count=w11) -> (session out=w14, error out=w15, read buffer=w16)
  call "Flush Buffer (Instr).gvi"(session in=w14, error in=w15, mode="Discard Receive and Transmit Buffers"(192)) -> (session out=w17, error out=w18)
  $"session out" <- w17
  $"error out" <- w18
  $subarray <- w16
  Array Subset(array=w16, index0=6, length0=16) -> w19
  $subarray_2 <- w19
  $"Bytes at Port" <- w11
  Array Index(array=w19) -> (out0[14]=w20, out1[15]=w21)
  Multiply(w20, 256) -> w22
  Add(w22, w21) -> w23
  Array Index(array=w19) -> (out0[0]=w24, out1[1]=w25)
  Multiply(w24, 256) -> w26
  Add(w26, w25) -> w27
  Array Index(array=w19) -> (out0[12]=w28, out1[13]=w29)
  Multiply(w28, 256) -> w30
  Add(w30, w29) -> w31
  Array Index(array=w19) -> (out0[8]=w32, out1[9]=w33)
  Multiply(w32, 256) -> w34
  Add(w34, w33) -> w35
  Array Index(array=w19) -> (out0[10]=w36, out1[11]=w37)
  Multiply(w36, 256) -> w38
  Add(w38, w37) -> w39
  Array Index(array=w19) -> (out0[2]=w40, out1[3]=w41)
  Multiply(w40, 256) -> w42
  Add(w42, w41) -> w43
  Array Index(array=w19) -> (out0[4]=w44, out1[5]=w45)
  Multiply(w44, 256) -> w46
  Add(w46, w45) -> w47
  Array Index(array=w19) -> (out0[6]=w48, out1[7]=w49)
  Multiply(w48, 256) -> w50
  Add(w50, w49) -> w51
  Build Array(w27, w43, w47, w51, w35, w39, w31, w23) -> w52
  $SmokeCalForGraph <- w52
  $sum <- w27
  $"appended array" <- w6
