vi "CommsLINK Module Commands_streamline.gvi"   [LabVIEW NXG 4.0.0]
inputs:
  "RF Dongle Tx": "VISA Instr" = "COM12"
  "error in": error
  "S1": string = "CF"
  "S2": string = "CF"
  "S3": string = "CF"
  "S4": string = "0B"
  "Custom Message 1": T1 = {"Type"="ED", "Length"="E3", "Repeat Level"="F0", "S1"="00", "S2"="00", "S3"="00", "S4"="00", "Ex1"="CD", "Ex2"="00", "Ex3"="00", "Ex4"="00"}
  "Custom Message 2": T1 = {"Type"="ED", "Length"="E3", "Repeat Level"="F0", "S1"="00", "S2"="00", "S3"="00", "S4"="00", "Ex1"="CD", "Ex2"="00", "Ex3"="00", "Ex4"="00"}
  "Custom Message 3": T1 = {"Type"="ED", "Length"="E3", "Repeat Level"="F0", "S1"="00", "S2"="00", "S3"="00", "S4"="00", "Ex1"="CD", "Ex2"="00", "Ex3"="00", "Ex4"="00"}
  "Custom Message 4": T1 = {"Type"="ED", "Length"="E3", "Repeat Level"="F0", "S1"="00", "S2"="00", "S3"="00", "S4"="00", "Ex1"="CD", "Ex2"="00", "Ex3"="00", "Ex4"="00"}
outputs:
  "Ready to Send": bool
  "Response HEX": string
  "Response": string
  "In Progress": bool
panel controls:
  "Type": enum{"Standard", "Extended"} = "Standard"
  "Cus Mes 1": bool
  "Cus Mes 2": bool
  "Cus Mes 3": bool
  "Cust Mess 4": bool
  "Chirp": bool
  "Piezo Control": bool
  "End Piezo Control": bool
  "Piezo Restart": bool
  "Fire Alarm": bool
  "CO Alarm": bool
  "Cancel": bool
  "Stop": bool
types:
  T1 = cluster{"Type": string, "Length": string, "Repeat Level": string, "S1": string, "S2": string, "S3": string, "S4": string, "Ex1": string, "Ex2": string, "Ex3": string, "Ex4": string}
uses:
  600SeriesTestEnvironment::ExtendedMessageBuildStart.gvi
  600SeriesTestEnvironment::SendCommandReceiveResponse.gvi
  600SeriesTestEnvironment::SendCommandNoResponse.gvi
  600SeriesTestEnvironment::CustomExtendedRFMessage.gvi
diagram:
  while {
    call "RFSerialString.gvi"(S1=$S1, S2=$S2, S3=$S3, S4=$S4) -> (RF Serial=w1)
    call "ExtendedMessageBuildStart.gvi"(S1=$S1, S2=$S2, S3=$S3, S4=$S4) -> (Output=w2)
    Build Cluster($"RF Dongle Tx", $"error in", w1, w2) -> w3
    case ($"Piezo Control") {
      frame False, Default { }
      frame True {
        call "SendCommandReceiveResponse.gvi"(cluster in=w3, Test Code="38") -> (Response HEX=w4, Response=w5, Ready to Send=w6)
        $"Response HEX" <- w4
        $Response <- w5
        Wait(time to wait=3000)
        $"Ready to Send" <- w6
        $"In Progress" <- TRUE
      }
    }
    case ($"End Piezo Control") {
      frame False, Default { }
      frame True {
        call "SendCommandReceiveResponse.gvi"(cluster in=w3, Test Code="C4") -> (Response HEX=w7, Response=w8, Ready to Send=w9)
        $"Response HEX" <- w7
        $Response <- w8
        $"Ready to Send" <- w9
        Wait(time to wait=3000)
        $"In Progress" <- TRUE
      }
    }
    case ($"Piezo Restart") {
      frame False, Default { }
      frame True {
        call "SendCommandReceiveResponse.gvi"(cluster in=w3, Test Code="49") -> (Response HEX=w10, Response=w11, Ready to Send=w12)
        $"Response HEX" <- w10
        $Response <- w11
        $"Ready to Send" <- w12
        Wait(time to wait=3000)
        $"In Progress" <- TRUE
      }
    }
    case ($Chirp) {
      frame False, Default { }
      frame True {
        call "SendCommandNoResponse.gvi"(cluster in=w3, Test Code="62")
        $"In Progress" <- TRUE
      }
    }
    case ($Cancel) {
      frame False, Default { }
      frame True {
        call "SendCommandNoResponse.gvi"(cluster in=w3, Test Code="94")
        $"In Progress" <- TRUE
      }
    }
    case ($"CO Alarm") {
      frame False, Default { }
      frame True {
        call "SendCommandNoResponse.gvi"(cluster in=w3, Test Code="34")
        $"In Progress" <- TRUE
      }
    }
    case ($"Fire Alarm") {
      frame False, Default { }
      frame True {
        call "SendCommandNoResponse.gvi"(cluster in=w3, Test Code="C2")
        $"In Progress" <- TRUE
      }
    }
    Build Cluster($"RF Dongle Tx", $"error in", $"Custom Message 1", $Type) -> w13
    case ($"Cus Mes 1") {
      frame False, Default { }
      frame True {
        call "CustomExtendedRFMessage.gvi"(cluster in=w13)
        $"In Progress" <- TRUE
      }
    }
    Build Cluster($"RF Dongle Tx", $"error in", $"Custom Message 2", $Type) -> w14
    case ($"Cus Mes 2") {
      frame False, Default { }
      frame True {
        call "CustomExtendedRFMessage.gvi"(cluster in=w14)
        $"In Progress" <- TRUE
      }
    }
    Build Cluster($"RF Dongle Tx", $"error in", $"Custom Message 3", $Type) -> w15
    case ($"Cus Mes 3") {
      frame False, Default { }
      frame True {
        call "CustomExtendedRFMessage.gvi"(cluster in=w15)
        $"In Progress" <- TRUE
      }
    }
    Build Cluster($"RF Dongle Tx", $"error in", $"Custom Message 4", $Type) -> w16
    case ($"Cust Mess 4") {
      frame False, Default { }
      frame True {
        call "CustomExtendedRFMessage.gvi"(cluster in=w16)
        $"In Progress" <- TRUE
      }
    }
    $"In Progress" <- FALSE
    $"Ready to Send" <- TRUE
    $"Response HEX" <- ""
    $Response <- ""
    stop if $Stop
  }
