vi "CommsLINK Request_streamline_2.gvi"   [LabVIEW NXG 4.0.0]
inputs:
  "S1": string = "CF"
  "RF Dongle Tx": "VISA Instr" = "COM12"
  "S2": string = "CF"
  "S3": string = "CF"
  "error in": error
  "S4": string = "0B"
  "Command / Request": enum{"Request", "Command"} = "Request"
  "Request": T1 = "Head Status Data"
outputs:
  "session out": "VISA Instr"
  "error out": error
  "HEX": u32[]
  "HEX (Parity Adjusted)": i64[]
  "DEC": u16
  "BIN": i32
  "Bit Array": bool[]
  "RF Message Received": bool
  "RF Message Received_2": bool
  "In Progress": bool
  "Ready to interrogate": bool
  "Head Status Results": T2
  "Current Indication Results": T4
  "Head Type Results": T6
  "End Of Life Results": T8
  "Temperature Result": cluster{"Temperature": i32}
  "Smoke Percentage Results": cluster{"Smoke Percentage": i32}
  "Alarm Information Results": T5
  "Dust Timer MSB Result": cluster{"Dust Timer MSB": i32}
  "Dust Timer LSB Result": cluster{"Dust Timer LSB": i32}
  "Dust Status Request Results": T7
  "Current Test": T1
panel controls:
  "Head Status": T2
  "Current Indication Data": T3
  "Smoke Percentage": cluster{"Smoke Percentage": i32}
  "Alarm Info": T5
  "Type": T6
  "Dust Stat": T7
  "Dust Timer MSB": cluster{"Dust Timer MSB": i32}
  "Dust Timer LSB": cluster{"Dust Timer LSB": i32}
  "EOL": T8
  "Temp Code": cluster{"Temperature": i32}
panel indicators:
  "RF Read iteration": i32
  "ACK": u8[]
  "Parity": bool
  "Future Use": bool
  "Future Use_2": bool
  "Batt Voltage": i32
  "Output DEC Smoke Level": i32
  "subarray": bool[]
types:
  T1 = enum{"Head Status Data", "Current Indication Data", "Head ID MS Word", "Head ID LS Word", "Type", "EOL", "Temp", "Alarm Information", "Smoke Percentage", "Dust Status Request", "Dust Timer MSB Request ", "Dust Timer LSB Request "}
  T2 = cluster{"Head Fault": bool, "Low Batt Flag": bool, "EOL Flag": bool, "Tamper": bool, "Battery Voltage": f64, "Dust Level": i32}
  T3 = cluster{"Test": bool, "Hush": bool, "Alarm Memory": bool, "Dusty Chamber": bool, "End of Life": bool, "Sensor Fault": bool, "Low Battery": bool, "AudioLINK": bool, "Piezo Control": bool, "Interconnect Alarm": bool, "Local Alarm": bool, "Standby": bool}
  T4 = cluster{"Test": bool, "Hush": bool, "Alarm Mem": bool, "Dusty Chamber": bool, "EOL": bool, "Sensor Fault": bool, "Low Batt": bool, "AudioLINK": bool, "Piezo Control": bool, "IC Alarm": bool, "Local Alarm": bool, "Standby": bool}
  T5 = cluster{"Smoke Level": string, "Multi-Criteria Alarm": bool, "Optical Gain Setting": bool, "Heat Alarm": string}
  T6 = cluster{"AudioLINK": bool, "Battery Level": bool, "Dust Compensation": bool, "CO Sensor": bool, "Heat Sensor": bool, "Optical Sensor": bool, "Ionisation Sensor": bool, "Head Type": string}
  T7 = cluster{"Supports LED Compensation": bool, "Dust Level Valid": bool, "LED Compensation Active": bool, "Max Dust Level": i32, "Current Dust Level": i32}
  T8 = cluster{"EOL (Years)": f64, "EOL (Days)": f64, "EOL Count (4 hour)": i32}
uses:
  NI::VISA::Open (Instr).gvi
  NI::VISA::Configure Serial Port (Instr).gvi
  NI::VISA::Flush Buffer (Instr).gvi
  600SeriesTestEnvironment::RFSerialString.gvi
  600SeriesTestEnvironment::BuildExtendedMessage.gvi
  600SeriesTestEnvironment::ExtendedMessageSendReceiveVI.gvi
  600SeriesTestEnvironment::ParseExtMessType.gvi
  600SeriesTestEnvironment::ConvertStringtoMSBLSNandParity.gvi
  600SeriesTestEnvironment::ConvertMSBLSBtoDEC.gvi
  600SeriesTestEnvironment::ConvertBINarraytoDEC.gvi
  600SeriesTestEnvironment::InitializeCommsLINKTestValues.gvi
diagram:
  case (TRUE) {
    frame False, Default { }
    frame True {
      w1 = [FALSE, FALSE, FALSE, FALSE, FALSE, FALSE, FALSE, FALSE, FALSE, FALSE, FALSE, FALSE, FALSE, FALSE, FALSE, FALSE]
      $"Bit Array" <- w1
      $"Ready to interrogate" <- FALSE
      $HEX <- u32[] []
      $"RF Message Received" <- FALSE
      $"HEX (Parity Adjusted)" <- u32[] []
      $"In Progress" <- TRUE
      case ($Request) {
        frame "Head Status Data", Default {
          case (TRUE) {
            frame False, Default { }
            frame True {
              $"Head Status Results" <- T2 {all zero or empty}
            }
          }
          w2 = "26"
        }
        frame "Current Indication Data" {
          case (TRUE) {
            frame False, Default { }
            frame True {
              $"Current Indication Results" <- T4 {all zero or empty}
            }
          }
          w2 = "2F"
        }
        frame "Head ID MS Word" {
          w2 = "B3"
        }
        frame "Head ID LS Word" {
          w2 = "B5"
        }
        frame "Type" {
          case (TRUE) {
            frame False, Default { }
            frame True {
              $"Head Type Results" <- T6 {all zero or empty}
            }
          }
          w2 = "6B"
        }
        frame "EOL" {
          case (TRUE) {
            frame False, Default { }
            frame True {
              $"End Of Life Results" <- T8 {all zero or empty}
            }
          }
          w2 = "89"
        }
        frame "Temp" {
          case (TRUE) {
            frame False, Default { }
            frame True {
              $"Temperature Result" <- cluster{"Temperature": i32} {all zero or empty}
            }
          }
          w2 = "8F"
        }
        frame "Alarm Information" {
          case (TRUE) {
            frame False, Default { }
            frame True {
              $"Alarm Information Results" <- T5 {all zero or empty}
            }
          }
          w2 = "6D"
        }
        frame "Smoke Percentage" {
          case (TRUE) {
            frame False, Default { }
            frame True {
              $"Smoke Percentage Results" <- cluster{"Smoke Percentage": i32} {all zero or empty}
            }
          }
          w2 = "AD"
        }
        frame "Dust Status Request" {
          case (TRUE) {
            frame False, Default { }
            frame True {
              $"Dust Status Request Results" <- T7 {all zero or empty}
            }
          }
          w2 = "29"
        }
        frame "Dust Timer MSB Request " {
          case (TRUE) {
            frame False, Default { }
            frame True {
              $"Dust Timer MSB Result" <- cluster{"Dust Timer MSB": i32} {all zero or empty}
            }
          }
          w2 = "2A"
        }
        frame "Dust Timer LSB Request " {
          case (TRUE) {
            frame False, Default { }
            frame True {
              $"Dust Timer LSB Result" <- cluster{"Dust Timer LSB": i32} {all zero or empty}
            }
          }
          w2 = "2C"
        }
      }
      call "Open (Instr).gvi"(resource name=$"RF Dongle Tx", error in=$"error in") -> (session out=w3, error out=w4)
      call "Configure Serial Port (Instr).gvi"(stop bits="1.0"(10), flow control="None"(0), session in=w3, error in=w4, baud rate=115200, data bits=8, parity="None"(0), timeout=10000, termination char=10, enable termination char=FALSE) -> (session out=w5, error out=w6)
      call "Flush Buffer (Instr).gvi"(session in=w5, error in=w6, mode="Discard Receive and Transmit Buffers"(192)) -> (session out=w7, error out=w8)
      call "RFSerialString.gvi"(S1=$S1, S2=$S2, S3=$S3, S4=$S4) -> (RF Serial=w9)
      case ($"Command / Request") {
        frame "Request", Default {
          w10 = "CE"
        }
        frame "Command" {
          w10 = "CD"
        }
      }
      call "BuildExtendedMessage.gvi"(S1=$S1, S2=$S2, S3=$S3, S4=$S4, Com/Req=w10, Code=w2) -> (RF Input String=w11)
      call "ExtendedMessageSendReceiveVI.gvi"(VISA IN=w7, RF Input String=w11, No. Bytes Lower Limit=33, Message Type to Match=w2, RF Serial Number to match=w9, Error_IN=w8) -> (VISA Out=w12, Correct ED Message Type Received from Specified Serial=w13, Extended Message Portion=w14, Error_Out=w15)
      call "Flush Buffer (Instr).gvi"(session in=w12, error in=w15, mode="Discard Receive and Transmit Buffers"(192)) -> (session out=w16, error out=w17)
      $"error out" <- w17
      $"RF Message Received" <- w13
      call "ParseExtMessType.gvi"(Input=w14) -> (String Input=w18)
      call "ConvertStringtoMSBLSNandParity.gvi"(Srting Input=w18, MSB Offset=25, LSB Offset=28) -> (Returned HEX=w19, Returned HEX (Parity Adjusted)=w20)
      call "ConvertMSBLSBtoDEC.gvi"(MSB LSB Array=w20) -> (DEC=w21)
      To Unsigned 16 Bit Integer(number=w21) -> w22
      Number To Boolean Array(number=w22) -> (Boolean array=w23)
      Reverse 1D Array(array=w23) -> (reversed array=w24)
      case ($Request) {
        frame "Head Status Data", Default {
          Array Index(array=w24) -> (out0[0]=w25)
          $Parity <- w25
          Array Index(array=w24) -> (out0[2]=w26)
          Array Index(array=w24) -> (out0[3]=w27)
          Array Index(array=w24) -> (out0[8]=w28)
          Array Index(array=w24) -> (out0[9]=w29)
          Array Subset(array=w24, index0=11, length0=5) -> w30
          call "ConvertBINarraytoDEC.gvi"(Array=w30) -> (Output DEC=w31)
          Array Subset(array=w24, index0=4, length0=4) -> w32
          call "ConvertBINarraytoDEC.gvi"(Array=w32) -> (Output DEC=w33)
          Divide(x=w33, y=10) -> w34
          Add(w34, 2) -> w35
          Property Node(instance in=$"Head Status", "Head Fault"=w26, "Low Batt Flag"=w27, "EOL Flag"=w28, "Tamper"=w29, "Battery Voltage"=w35, "Dust Level"=w31) -> (instance out=w36)
          $"Head Status Results" <- w36
          Array Index(array=w24) -> (out0[1]=w37)
          $"Future Use" <- w37
          Array Index(array=w24) -> (out0[10]=w38)
          $"Future Use_2" <- w38
          $"In Progress" <- FALSE
          $"Batt Voltage" <- w33
        }
        frame "Current Indication Data" {
          Array Index(array=w24) -> (out0[4]=w39)
          Array Index(array=w24) -> (out0[5]=w40)
          Array Index(array=w24) -> (out0[6]=w41)
          Array Index(array=w24) -> (out0[7]=w42)
          Array Index(array=w24) -> (out0[8]=w43)
          Array Index(array=w24) -> (out0[9]=w44)
          Array Index(array=w24) -> (out0[10]=w45)
          Array Index(array=w24) -> (out0[11]=w46)
          Array Index(array=w24) -> (out0[12]=w47)
          Array Index(array=w24) -> (out0[13]=w48)
          Array Index(array=w24) -> (out0[14]=w49)
          Array Index(array=w24) -> (out0[15]=w50)
          Property Node(instance in=$"Current Indication Data", "Test"=w39, "Hush"=w40, "Alarm Memory"=w41, "Dusty Chamber"=w42, "End of Life"=w43, "Sensor Fault"=w44, "Low Battery"=w45, "AudioLINK"=w46, "Piezo Control"=w47, "Interconnect Alarm"=w48, "Local Alarm"=w49, "Standby"=w50) -> (instance out=w51)
          $"Current Indication Results" <- w51
          $"In Progress" <- FALSE
        }
        frame "Head ID MS Word" {
          $"In Progress" <- FALSE
        }
        frame "Head ID LS Word" {
          $"In Progress" <- FALSE
        }
        frame "Type" {
          case (w21) {
            frame 32874 {
              w52 = "Ei660 – Non-AudioLINK"
            }
            frame 362 {
              w52 = "Ei660i – AudioLINK"
            }
            frame 98 {
              w52 = "Ei650 – Non-AudioLINK"
            }
            frame 33122 {
              w52 = "Ei650i – AudioLINK"
            }
            frame 32840 {
              w52 = "Ei630 – Non-AudioLINK"
            }
            frame 328 {
              w52 = "Ei630i - AudioLINK"
            }
            frame 0, Default {
              w52 = "No Head Type Returned"
            }
          }
          Array Index(array=w24) -> (out0[7]=w53)
          Array Index(array=w24) -> (out0[9]=w54)
          Array Index(array=w24) -> (out0[10]=w55)
          Array Index(array=w24) -> (out0[11]=w56)
          Array Index(array=w24) -> (out0[12]=w57)
          Array Index(array=w24) -> (out0[14]=w58)
          Array Index(array=w24) -> (out0[15]=w59)
          Property Node(instance in=$Type, "AudioLINK"=w53, "Battery Level"=w54, "Dust Compensation"=w55, "CO Sensor"=w56, "Heat Sensor"=w57, "Optical Sensor"=w58, "Ionisation Sensor"=w59, "Head Type"=w52) -> (instance out=w60)
          $"Head Type Results" <- w60
          $"In Progress" <- FALSE
        }
        frame "EOL" {
          Array Subset(array=w24, index0=1) -> w61
          call "ConvertBINarraytoDEC.gvi"(Array=w61) -> (Output DEC=w62)
          Divide(x=w62, y=6) -> w63
          Divide(x=w63, y=365) -> w64
          Property Node(instance in=$EOL, "EOL Count (4 hour)"=w62, "EOL (Days)"=w63, "EOL (Years)"=w64) -> (instance out=w65)
          $"End Of Life Results" <- w65
          $"In Progress" <- FALSE
        }
        frame "Temp" {
          Array Subset(array=w24, index0=9) -> w66
          call "ConvertBINarraytoDEC.gvi"(Array=w66) -> (Output DEC=w67)
          Subtract(x=w67, y=20) -> w68
          Property Node(instance in=$"Temp Code", "Temperature"=w68) -> (instance out=w69)
          $"Temperature Result" <- w69
          $"In Progress" <- FALSE
        }
        frame "Alarm Information" {
          Array Index(array=w24) -> (out0[10]=w70)
          Array Index(array=w24) -> (out0[11]=w71)
          Array Subset(array=w24, index0=14, length0=2) -> w72
          call "ConvertBINarraytoDEC.gvi"(Array=w72) -> (Output DEC=w73)
          case (w73) {
            frame 0, Default {
              w74 = "Below 0.49 alarm level"
            }
            frame 1 {
              w74 = "Between 0.5 – 0.74 alarm level"
            }
            frame 2 {
              w74 = "Between 0.75 – 0.99 alarm level"
            }
            frame 3 {
              w74 = "In alarm"
            }
          }
          Array Subset(array=w24, index0=12, length0=2) -> w75
          call "ConvertBINarraytoDEC.gvi"(Array=w75) -> (Output DEC=w76)
          case (w76) {
            frame 0 {
              w77 = "No alarm"
            }
            frame 1 {
              w77 = "Temperature threshold reached"
            }
            frame 2 {
              w77 = "Rate of rise alarm triggered"
            }
            frame 3, Default {
              w77 = "No value returned"
            }
          }
          Property Node(instance in=$"Alarm Info", "Smoke Level"=w74, "Multi-Criteria Alarm"=w70, "Optical Gain Setting"=w71, "Heat Alarm"=w77) -> (instance out=w78)
          $"Alarm Information Results" <- w78
          $subarray <- w72
          $"Output DEC Smoke Level" <- w73
          $"In Progress" <- FALSE
        }
        frame "Smoke Percentage" {
          Array Subset(array=w24, index0=8) -> w79
          call "ConvertBINarraytoDEC.gvi"(Array=w79) -> (Output DEC=w80)
          Property Node(instance in=$"Smoke Percentage", "Smoke Percentage"=w80) -> (instance out=w81)
          $"Smoke Percentage Results" <- w81
          $"In Progress" <- FALSE
        }
        frame "Dust Status Request" {
          Array Index(array=w24) -> (out0[1]=w82)
          Array Index(array=w24) -> (out0[8]=w83)
          Array Index(array=w24) -> (out0[9]=w84)
          Array Subset(array=w24, index0=2, length0=6) -> w85
          call "ConvertBINarraytoDEC.gvi"(Array=w85) -> (Output DEC=w86)
          Array Subset(array=w24, index0=10, length0=6) -> w87
          call "ConvertBINarraytoDEC.gvi"(Array=w87) -> (Output DEC=w88)
          Property Node(instance in=$"Dust Stat", "Supports LED Compensation"=w82, "Dust Level Valid"=w83, "LED Compensation Active"=w84, "Max Dust Level"=w86, "Current Dust Level"=w88) -> (instance out=w89)
          $"Dust Status Request Results" <- w89
          $"In Progress" <- FALSE
        }
        frame "Dust Timer MSB Request " {
          Array Subset(array=w24, index0=8) -> w90
          call "ConvertBINarraytoDEC.gvi"(Array=w90) -> (Output DEC=w91)
          Property Node(instance in=$"Dust Timer MSB", "Dust Timer MSB"=w91) -> (instance out=w92)
          $"Dust Timer MSB Result" <- w92
          $"In Progress" <- FALSE
        }
        frame "Dust Timer LSB Request " {
          Array Subset(array=w24, index0=8) -> w93
          call "ConvertBINarraytoDEC.gvi"(Array=w93) -> (Output DEC=w94)
          Property Node(instance in=$"Dust Timer LSB", "Dust Timer LSB"=w94) -> (instance out=w95)
          $"Dust Timer LSB Result" <- w95
          $"In Progress" <- FALSE
        }
      }
      $"session out" <- w16
      $HEX <- w19
      $"HEX (Parity Adjusted)" <- w20
      $"Bit Array" <- w24
      $BIN <- w21
      $DEC <- w21
      $"Current Test" <- $Request
      Wait(time to wait=1000)
    }
  }
  $"In Progress" <- FALSE
  $"Ready to interrogate" <- TRUE
  call "InitializeCommsLINKTestValues.gvi"() -> (HEX (Parity Adjusted)=w96, HEX=w97, RF Read iteration=w98, ACK=w99, BIN=w100, DEC=w101, Bit Array=w102, RF Message Received_2=w103, Ready to interrogate=w104, In Progress=w105, RF Message Received=w106, Head Status Results=w107, Current Indication Results=w108, Smoke Percentage Results=w109, Alarm Information Results=w110, Head Type Results=w111, Dust Status Request Results=w112, Temperature Result=w113, End Of Life Results=w114, Dust Timer MSB Result=w115, Dust Timer LSB Result=w116)
  $"HEX (Parity Adjusted)" <- w96
  $HEX <- w97
  $"RF Read iteration" <- w98
  $ACK <- w99
  $BIN <- w100
  $DEC <- w101
  $"Bit Array" <- w102
  $"Ready to interrogate" <- w104
  $"RF Message Received_2" <- w103
  $"In Progress" <- w105
  $"RF Message Received" <- w106
  $"Head Status Results" <- w107
  $"Current Indication Results" <- w108
  $"Smoke Percentage Results" <- w109
  $"Alarm Information Results" <- w110
  $"Head Type Results" <- w111
  $"Dust Status Request Results" <- w112
  $"Temperature Result" <- w113
  $"End Of Life Results" <- w114
  $"Dust Timer MSB Result" <- w115
  $"Dust Timer LSB Result" <- w116
