vi "CommsLINKAutoTest.gvi"   [LabVIEW NXG 4.0.0]
# The Vi allows the user to automatically cycle throught the commsLINK protocol and confirm that the responses are correct.
inputs:
  "UART In": "VISA Instr" = "COM11"
  "RF Dongle In": "VISA Instr" = "COM11"
  "Run": bool
  "Test Results": T2
  "S1": string = "CF"
  "S2": string = "CF"
  "S3": string = "CF"
  "S4": string = "0B"
  "Command / Request": enum{"Request", "Command"} = "Request"
  "Stop CommsLINK": bool
  "UART In_2": error
outputs:
  "UART ACK": bool
  "Previous Step Results": T2
  "InitialisationCluster": T3
  "Output": T2[]
  "appended array": i64[]
  "Sent (Parity)": i64[]
  "Test Step": T1
  "Sent": i64[]
  "String Constant": string
  "Individual Results": bool[]
  "Overall Result": bool
  "Head ID MS Word": bool
  "Current Indication Data": bool
  "Alarm Info": bool
  "Temp": bool
  "Head ID LS Word": bool
  "Head Status Data": bool
  "EOL": bool
  "Type": bool
  "Smoke Percentage": bool
  "Output_2": T2
  "Output_3": "VISA Instr"
  "error in": error
panel indicators:
  "current time": timestamp
  "x - y": f64
types:
  T1 = enum{"Head Status Data", "Current Indication Data", "Head ID MS Word", "Head ID LS Word", "Type", "EOL", "Temp", "Alarm Information", "Smoke Percentage", "Stop"}
  T2 = cluster{"UART ACK": bool, "Test Step": T1, "ED Message Rx": bool, " Test Pass": bool, "No RF response received": bool, "Sent": i64[], "Sent (Parity)": i64[], "Returned": u32[], "Returned (Parity)": i64[], "RF Serial Number": string, "Signal Strength": i32, "Type (Byte)": string, "Test (Byte)": string, "Test (Name)": string}
  T3 = cluster{"RF response_2": bool, "ED Message Received_2": bool, "UART ACK_2": bool, "Returned (Parity)": u32[], "Test Type Match": bool, "Type_2": bool, "Head Status Data": bool, "Sent": u32[], "Smoke Percentage_2": bool, "Current Indication Data": bool, "Sent (Parity)": u32[], "Temp_2": bool, "Head ID MS Word": bool, "RF Read iteration": i32, "Head ID LS Word_2": bool, "Returned": u32[], "Head ID LS Word": bool, "Head Status Data_2": bool, "Type": bool, "Alarm Info_2": bool, "EOL": bool, "ACK": u8[], "Current Indication Data_2": bool, "Temp": bool, "EOL_2": bool, "RF response ": bool, "Alarm Info": bool, "Head ID MS Word_2": bool, "Smoke Percentage": bool, "Test Pass_2": bool, "Overall Result": bool, "Overall Result_2": bool, "Individual Results": bool[]}
uses:
  NI::VISA::Open (Instr).gvi
  NI::VISA::Configure Serial Port (Instr).gvi
  NI::VISA::Flush Buffer (Instr).gvi
  600SeriesTestEnvironment::RfTestInitialise.gvi
  600SeriesTestEnvironment::CRC.gvi
diagram:
  case ($"Command / Request") {
    frame "Request", Default {
      w1 = "CE"
    }
    frame "Command" {
      w1 = "CD"
    }
  }
  call "Open (Instr).gvi"(resource name=$"RF Dongle In") -> (session out=w2, error out=w3)
  call "Configure Serial Port (Instr).gvi"(stop bits="1.0"(10), flow control="None"(0), session in=w2, error in=w3, baud rate=115200, data bits=8, parity="None"(0), enable termination char=FALSE) -> (session out=w4, error out=w5)
  call "Flush Buffer (Instr).gvi"(session in=w4, error in=w5, mode="Discard Receive and Transmit Buffers"(192)) -> (session out=w6)
  case ($Run) {
    frame False, Default {
      w7 = default
    }
    frame True {
      call "RfTestInitialise.gvi"() -> (Cluster=w8)
      $InitialisationCluster <- w8
      case (FALSE) {
        frame False, Default {
          w9 = default
        }
        frame True {
          w9 = T2[] []
        }
      }
      s1 = "Head Status Data"  # shift register
      s2 = bool[] []  # shift register
      s3 = w9  # shift register
      while {
        $"Test Step" <- s1
        case (s1) {
          frame "Head Status Data", Default {
            w10 = 38
            w11 = "26"
            w12 = "Current Indication Data"
            w13 = TRUE
          }
          frame "Current Indication Data" {
            w10 = 47
            w11 = "2F"
            w12 = "Head ID MS Word"
            w13 = TRUE
          }
          frame "Head ID MS Word" {
            w10 = 179
            w11 = "B3"
            w12 = "Head ID LS Word"
            w13 = TRUE
          }
          frame "Head ID LS Word" {
            w10 = 181
            w11 = "B5"
            w12 = "Type"
            w13 = TRUE
          }
          frame "Type" {
            w10 = 107
            w11 = "6B"
            w12 = "EOL"
            w13 = TRUE
          }
          frame "EOL" {
            w10 = 137
            w11 = "89"
            w12 = "Temp"
            w13 = TRUE
          }
          frame "Temp" {
            w10 = 143
            w11 = "8F"
            w12 = "Alarm Information"
            w13 = TRUE
          }
          frame "Alarm Information" {
            w10 = 109
            w11 = "6D"
            w12 = "Smoke Percentage"
            w13 = TRUE
          }
          frame "Smoke Percentage" {
            w10 = 173
            w11 = "AD"
            w12 = "Stop"
            w13 = TRUE
          }
          frame "Stop" {
            w10 = 0
            w11 = ""
            w12 = "Stop"
            w13 = FALSE
          }
        }
        case (w13) {
          frame False, Default {
            w14 = TRUE
            w15 = s2
            w16 = default
            w7 = $"UART In"
          }
          frame True {
            call "GenerateRandomValues.gvi"() -> (ElementForBuildArray=w17, Sent (Parity)=w18, SentParityToCluster=w19, Sent=w20, MSB=w21, LSB=w22)
            Build Array([0, 85, 5], w10, w17) -> w23
            # w21: MSB
            Array Subset(array=w23, index0=3) -> w24
            call "CRC.gvi"(Input for CRC Calculation=w24) -> (MSB=w25, LSB=w26)
            Build Array(w23, w25, w26) -> w27
            call "WriteTestValues.gvi"(Input=$"UART In", Input_2=$"UART In_2", appended array_2=w27) -> (Output_3=w28, Output_2=w29, Output_4=w30)
            $"UART ACK" <- w30
            call "BuildRFComandString.gvi"(Input_3=w11, Input=$S1, Input_4=$S2, Input_2=$S3, Input_5=$S4, Input_6=w1) -> (string {0}=w31)
            Concatenate Strings(w31, "\r", "\r\n") -> w32
            for (N = 1) (after w30) {
              call "Flush Buffer (Instr).gvi"(session in=w28, error in=w29, mode="Discard Receive and Transmit Buffers"(192)) -> (error out=w33)
              Wait(time to wait=2500)
            }
            case (w30) {
              frame False, Default {
                # No ACK
                Build Array(FALSE, s2) -> w15
                $"String Constant" <- "Im here "
                w34 = T2 {all zero or empty}
                w7 = default
              }
              frame True {
                call "SendReceiveRFmessage.gvi"(Input_2=w6, Input=w33, Input_3=w32) -> (session in=w7, error in=w35, ED Message Rx=w36, RF Serial Number_2=w37, x=w38, input 1=w39, string=w40)
                $"error in" <- w35
                Not(x=w38) -> w41
                Logical And(w41, w39) -> w42
                Search Or Split String(offset=21, search string/char="Extended Protocol:", string=w40) -> (match + rest of string=w43)
                String Subset(length (rest)=2, offset (0)=19, string=w43) -> w44
                String Subset(length (rest)=2, offset (0)=22, string=w43) -> w45
                Search Or Split String(offset=0, search string/char=" dBm", string=w40) -> (substring before match=w46)
                Search Or Split String(offset=0, search string/char="-", string=w46) -> (match + rest of string=w47)
                Decimal String To Number(string=w47) -> (number=w48)
                Hexadecimal String To Number(string=w45) -> (number=w49)
                Is Equal(x=w10, y=w49) -> w50
                call "ParseParityBytes.gvi"(match and rest of string=w43, TestTypeMatch=w50, Input_2=w21, Input=w22) -> (Returned_2=w51, Returned (Parity)_2=w52, overallResult=w53)
                case (w49) {
                  frame 1, Default {
                    # 01
                    # 1
                    w54 = "Enter CommsLINK Test"
                  }
                  frame 255 {
                    # FF
                    # 255
                    w54 = "Exit CommsLINK Test"
                  }
                  frame 38 {
                    # 26
                    # 38
                    w54 = "Head Status Data"
                  }
                  frame 47 {
                    # 2F
                    # 47
                    w54 = "Current Indication Data"
                  }
                  frame 179 {
                    # B3
                    # 179
                    w54 = "Head ID MSWord"
                  }
                  frame 181 {
                    # B5
                    # 181
                    w54 = "Head ID LSWord"
                  }
                  frame 107 {
                    # 6B
                    # 107
                    w54 = "Type"
                  }
                  frame 137 {
                    # 89
                    # 137
                    w54 = "EOL"
                  }
                  frame 143 {
                    # 8F
                    # 143
                    w54 = "Temp"
                  }
                  frame 109 {
                    # 6D
                    # 109
                    w54 = "Alarm Information"
                  }
                  frame 173 {
                    # AD
                    # 173
                    w54 = "Smoke Percentage"
                  }
                  frame 0 {
                    # 0
                    # Test
                    w54 = "Test"
                  }
                }
                Property Node(instance in=reference to "UART ACK") -> ("Value"=w55)
                Property Node(instance in=$"Test Results", "UART ACK"=w55, "Test Step"=s1, "Sent"=w17, "Sent (Parity)"=w19, "ED Message Rx"=w36, "RF Serial Number"=w37, "Signal Strength"=w48, "Type (Byte)"=w44, "Test (Byte)"=w45, "Test (Name)"=w54, "Returned"=w51, "Returned (Parity)"=w52, "No RF response received"=w42, " Test Pass"=w53) -> (instance out=w34)
                Build Array(w53, s2) -> w15
                case (s1) {
                  frame "Head Status Data", Default {
                    $"Head Status Data" <- w53
                  }
                  frame "Current Indication Data" {
                    $"Current Indication Data" <- w53
                  }
                  frame "Head ID MS Word" {
                    $"Head ID MS Word" <- w53
                  }
                  frame "Head ID LS Word" {
                    $"Head ID LS Word" <- w53
                  }
                  frame "Type" {
                    $Type <- w53
                  }
                  frame "EOL" {
                    $EOL <- w53
                  }
                  frame "Temp" {
                    $Temp <- w53
                  }
                  frame "Alarm Information" {
                    $"Alarm Info" <- w53
                  }
                  frame "Smoke Percentage" {
                    $"Smoke Percentage" <- w53
                  }
                  frame "Stop" { }
                }
              }
            }
            $"Previous Step Results" <- w34
            Build Array(w34, s3) -> w16
            $Output <- w16
            $Output_2 <- w34
            $"appended array" <- w27
            $"Sent (Parity)" <- w18
            # w22: LSB
            $Sent <- w20
            $"Individual Results" <- w15
            w14 = default
          }
        }
        Logical Or(w14, $"Stop CommsLINK") -> w56
        next s1 = w12
        next s2 = w15
        next s3 = w16
        stop if w56
      }
      Is Equal(x=s2, y=[TRUE, TRUE, TRUE, TRUE, TRUE, TRUE, TRUE, TRUE, TRUE]) -> w57
      Array Index(array=w57) -> (out0[0]=w58, out1[1]=w59, out2[2]=w60, out3[3]=w61, out4[4]=w62, out5[5]=w63, out6[6]=w64, out7[7]=w65, out8[8]=w66)
      case (w60) {
        frame False, Default { }
        frame True {
          Get Current Time() -> (current time=w67)
          Property Node(instance in=reference to "current time") -> ("Value"=w68)
          Time Stamp Subtract(x=w67, y=w68) -> w69
          $"x - y" <- w69
        }
      }
      Logical And(w58, w59, w60, w61, w62, w63, w64, w65, w66) -> w70
      $"Overall Result" <- w70
    }
  }
  $Output_3 <- w7
  case ($Run) {
    frame False, Default { }
    frame True {
      Get Current Time() -> (current time=w71)
      $"current time" <- w71
    }
  }
