vi "Confirm test mode entry ack.gvi"   [LabVIEW NXG 4.0.0]
# This Vi confirms that a unit has successfully endtered test mode before entering the test environment.
inputs:
  "Input": "VISA Instr"
  "Input_2": error
outputs:
  "Output": "VISA Instr"
  "Output_2": bool
  "Output_3": error
  "error out": error
panel indicators:
  "read buffer": u8[]
uses:
  NI::VISA::Read (Instr, Bytes).gvi
diagram:
  call "Read (Instr, Bytes).gvi"(session in=$Input, error in=$Input_2, byte count=6) -> (session out=w1, error out=w2, read buffer=w3)
  $Output <- w1
  $"error out" <- w2
  $"read buffer" <- w3
  $Output_3 <- w2
  w4 = [0, 85, 3, 255, 255, 0]  # Acknowledge Message
  Array Index(array=w4) -> (out0[0]=w5, out1[1]=w6, out2[2]=w7, out3[3]=w8, out4[4]=w9, out5[5]=w10)
  Array Index(array=w3) -> (out0[0]=w11, out1[1]=w12, out2[2]=w13, out3[3]=w14, out4[4]=w15, out5[5]=w16)
  Is Equal(x=w11, y=w5) -> w17
  Is Equal(x=w12, y=w6) -> w18
  Is Equal(x=w13, y=w7) -> w19
  Is Equal(x=w14, y=w8) -> w20
  Is Equal(x=w15, y=w9) -> w21
  Is Equal(x=w16, y=w10) -> w22
  Logical And(w17, w18, w19, w20, w21, w22) -> w23
  $Output_2 <- w23
