vi "ContinuousTestMode.gvi"   [LabVIEW NXG 4.0.0]
# Keeps the unit in test mode while attached to the test environment.
inputs:
  "loop iteration_3": i32
  "Input": "VISA Instr"
outputs:
  "Time until test mode re-entry message": f64
  "error in_2": error
  "session out": "VISA Instr"
uses:
  NI::VISA::Write (Instr, Bytes).gvi
diagram:
  Quotient And Remainder(x=$"loop iteration_3", y=30) -> (x-y*floor(x/y)=w1)
  Is Equal To 0(x=w1) -> w2
  case (w2) {
    frame False, Default {
      w3 = default
    }
    frame True {
      for (N = 1) {
        call "Write (Instr, Bytes).gvi"(session in=$Input, write buffer=[0, 85, 3, 84, 251, 129]) -> (session out=w4, error out=w3)
        $"session out" <- w4
      }
    }
  }
  $"error in_2" <- w3
  $"Time until test mode re-entry message" <- w1
