vi "ConvertBINarraytoDEC.gvi"   [LabVIEW NXG 4.0.0]
inputs:
  "Array": bool[]
outputs:
  "Output DEC": i32
diagram:
  Array Size(array=$Array) -> (size(s)=w1)
  Reverse 1D Array(array=$Array) -> (reversed array=w2)
  s1 = 0  # shift register
  for (N = w1) (iteration -> i1) {
    Array Index(array=w2) -> (out0[i1]=w3)
    case (i1) {
      frame 0, Default {
        case (w3) {
          frame False, Default {
            w4 = s1
          }
          frame True {
            Add(s1, 1) -> w4
          }
        }
      }
      frame 1 {
        case (w3) {
          frame False, Default {
            w4 = s1
          }
          frame True {
            Add(s1, 2) -> w4
          }
        }
      }
      frame 2 {
        case (w3) {
          frame False, Default {
            w4 = s1
          }
          frame True {
            Add(s1, 4) -> w4
          }
        }
      }
      frame 3 {
        case (w3) {
          frame False, Default {
            w4 = s1
          }
          frame True {
            Add(s1, 8) -> w4
          }
        }
      }
      frame 4 {
        case (w3) {
          frame False, Default {
            w4 = s1
          }
          frame True {
            Add(s1, 16) -> w4
          }
        }
      }
      frame 5 {
        case (w3) {
          frame False, Default {
            w4 = s1
          }
          frame True {
            Add(s1, 32) -> w4
          }
        }
      }
      frame 6 {
        case (w3) {
          frame False, Default {
            w4 = s1
          }
          frame True {
            Add(s1, 64) -> w4
          }
        }
      }
      frame 7 {
        case (w3) {
          frame False, Default {
            w4 = s1
          }
          frame True {
            Add(s1, 128) -> w4
          }
        }
      }
      frame 8 {
        case (w3) {
          frame False, Default {
            w4 = s1
          }
          frame True {
            Add(s1, 256) -> w4
          }
        }
      }
      frame 9 {
        case (w3) {
          frame False, Default {
            w4 = s1
          }
          frame True {
            Add(s1, 512) -> w4
          }
        }
      }
      frame 10 {
        case (w3) {
          frame False, Default {
            w4 = s1
          }
          frame True {
            Add(s1, 1024) -> w4
          }
        }
      }
      frame 11 {
        case (w3) {
          frame False, Default {
            w4 = s1
          }
          frame True {
            Add(s1, 2048) -> w4
          }
        }
      }
      frame 12 {
        case (w3) {
          frame False, Default {
            w4 = s1
          }
          frame True {
            Add(s1, 4096) -> w4
          }
        }
      }
      frame 13 {
        case (w3) {
          frame False, Default {
            w4 = s1
          }
          frame True {
            Add(s1, 8192) -> w4
          }
        }
      }
      frame 14 {
        case (w3) {
          frame False, Default {
            w4 = s1
          }
          frame True {
            Add(s1, 16384) -> w4
          }
        }
      }
      frame 15 {
        case (w3) {
          frame False, Default {
            w4 = s1
          }
          frame True {
            Add(s1, 32768) -> w4
          }
        }
      }
    }
    next s1 = w4
  }
  $"Output DEC" <- s1
