vi "ConvertMSBLSBtoDEC.gvi"   [LabVIEW NXG 4.0.0]
inputs:
  "MSB LSB Array": i64[]
outputs:
  "DEC": u16
diagram:
  Array Index(array=$"MSB LSB Array") -> (out0[1]=w1)
  Array Index(array=$"MSB LSB Array") -> (out0[0]=w2)
  Multiply(w2, 256) -> w3: u64
  Add(w1, w3) -> w4
  $DEC <- w4
