vi "ConvertStringtoMSBLSNandParity.gvi"   [LabVIEW NXG 4.0.0]
inputs:
  "Srting Input": string
  "MSB Offset": i32 = 25
  "LSB Offset": i32 = 28
outputs:
  "Returned HEX": u32[]
  "Returned HEX (Parity Adjusted)": i64[]
diagram:
  String Subset(length (rest)=2, offset (0)=$"MSB Offset", string=$"Srting Input") -> w1
  Hexadecimal String To Number(string=w1) -> (number=w2)
  String Subset(length (rest)=2, offset (0)=$"LSB Offset", string=$"Srting Input") -> w3
  Hexadecimal String To Number(string=w3) -> (number=w4)
  Build Array(w2, w4) -> w5
  $"Returned HEX" <- w5
  Logical And(w5, [127, 255]) -> w6
  $"Returned HEX (Parity Adjusted)" <- w6
