vi "CustomExtendedRFMessage.gvi"   [LabVIEW NXG 4.0.0]
inputs:
  "cluster in": T2
outputs:
  "error out_16": error
types:
  T1 = cluster{"Code": string, "Length": string, "Repeat Level": string, "S1": string, "S2": string, "S3": string, "S4": string, "Ex1": string, "Ex2": string, "Ex3": string, "Ex4": string, "Type": enum{"Extended", "Standard"}}
  T2 = cluster{"VISA": "VISA Instr", "Error In": error, "Message": T1}
uses:
  NI::VISA::Open (Instr).gvi
  NI::VISA::Configure Serial Port (Instr).gvi
  NI::VISA::Flush Buffer (Instr).gvi
  NI::VISA::Write (Instr, String).gvi
diagram:
  Property Node(instance in=$"cluster in") -> ("VISA"=w1, "Error In"=w2, "Message"=w3)
  # w3: Custom Message
  Property Node(instance in=w3) -> ("Code"=w4, "Length"=w5, "Repeat Level"=w6, "S1"=w7, "S2"=w8, "S3"=w9, "S4"=w10, "Ex1"=w11, "Ex2"=w12, "Ex3"=w13, "Ex4"=w14, "Type"=w15)
  case (w15) {
    frame "Standard", Default {
      w16 = "*tx"
    }
    frame "Extended" {
      w16 = "*extend"
    }
  }
  Concatenate Strings(w16, ",", w4, ",", w5, ",", w6, ",", w7, ",", w8, ",", w9, ",", w10, ",", w11, ",", w12, ",", w13, ",", w14) -> w17
  Concatenate Strings(w17, "\r", "\r\n") -> w18
  call "Open (Instr).gvi"(resource name=w1, error in=w2) -> (session out=w19, error out=w20)
  call "Configure Serial Port (Instr).gvi"(stop bits="1.0"(10), flow control="None"(0), session in=w19, error in=w20, baud rate=115200, data bits=8, parity="None"(0), timeout=10000, termination char=10, enable termination char=FALSE) -> (session out=w21, error out=w22)
  # w23: VISA In
  call "Flush Buffer (Instr).gvi"(session in=w21, error in=w22, mode="Discard Receive and Transmit Buffers"(192)) -> (session out=w23, error out=w24)
  call "Write (Instr, String).gvi"(session in=w23, error in=w24, write buffer=w18) -> (session out=w25, error out=w26)
  call "Flush Buffer (Instr).gvi"(session in=w25, error in=w26, mode="Discard Receive and Transmit Buffers"(192)) -> (error out=w27)
  $"error out_16" <- w27
