vi "EEPROMRead.gvi"   [LabVIEW NXG 4.0.0]
# Generic EEPROM Read V. This Vi will allow the user to read up to 16 bytes from any UART enabled Ei Products. to be used in conjunction with the Test mode entry Vi.
inputs:
  "resource name": "VISA Instr" = "COM25"
  "error in": error
  "Bytes to read": u32[]
outputs:
  "EEPROM Read Responce": u8[]
  "session out": "VISA Instr"
  "error out_4": error
  "Bytes at Port": u32
uses:
  NI::VISA::Open (Instr).gvi
  NI::VISA::Configure Serial Port (Instr).gvi
  NI::VISA::Flush Buffer (Instr).gvi
  600SeriesTestEnvironment::CRC.gvi
  NI::VISA::Write (Instr, Bytes).gvi
  NI::VISA::Read (Instr, Bytes).gvi
diagram:
  call "Open (Instr).gvi"(resource name=$"resource name", error in=$"error in") -> (session out=w1, error out=w2)
  call "Configure Serial Port (Instr).gvi"(session in=w1, error in=w2, baud rate=19200, enable termination char=FALSE) -> (session out=w3, error out=w4)
  call "Flush Buffer (Instr).gvi"(session in=w3, error in=w4, mode="Discard Receive and Transmit Buffers"(192)) -> (session out=w5, error out=w6)
  Build Array([62], $"Bytes to read") -> w7
  Array Size(array=w7) -> (size(s)=w8)
  Add(w8, 2) -> w9
  Build Array([0, 85], w9, w7) -> w10
  Array Subset(array=w10, index0=3) -> w11
  call "CRC.gvi"(Input for CRC Calculation=w11) -> (MSB=w12, LSB=w13)
  Build Array(w10, w12, w13) -> w14
  call "Write (Instr, Bytes).gvi"(session in=w5, error in=w6, write buffer=w14) -> (session out=w15, error out=w16)
  for (N = 1) {
    Wait(time to wait=1000)
  }
  Property Node(instance in=w15, error in=w16) -> ("ASRL Bytes at Port"=w17, error out=w18, instance out=w19)
  call "Read (Instr, Bytes).gvi"(session in=w19, error in=w18, byte count=w17) -> (session out=w20, error out=w21, read buffer=w22)
  $"session out" <- w20
  $"error out_4" <- w21
  $"EEPROM Read Responce" <- w22
  $"Bytes at Port" <- w17
