vi "ExtendedMessageSendReceiveVI.gvi"   [LabVIEW NXG 4.0.0]
inputs:
  "VISA IN": "VISA Instr" = "COM12"
  "RF Input String": string
  "No. Bytes Lower Limit": u32 = 33
  "Message Type to Match": string
  "RF Serial Number to match": string
  "Error_IN": error
outputs:
  "VISA Out": "VISA Instr"
  "Correct ED Message Type Received from Specified Serial": bool
  "Extended Message Portion": string
  "Error_Out": error
uses:
  NI::VISA::Write (Instr, String).gvi
  NI::VISA::Read (Instr, String).gvi
diagram:
  for (N = 3) {
    for (N = 1) {
      call "Write (Instr, String).gvi"(session in=$"VISA IN", error in=$Error_IN, write buffer=$"RF Input String") -> (session out=w1, error out=w2)
      Wait(time to wait=1)
    }
    while (iteration -> i1) {
      Wait(time to wait=100)
      # check user ID
      Property Node(instance in=w1, error in=w2) -> ("ASRL Bytes at Port"=w3, error out=w4, instance out=w5)
      call "Read (Instr, String).gvi"(session in=w5, error in=w4, byte count=w3) -> (session out=w6, error out=w7, read buffer=w8)
      Is Greater(x=w3, y=$"No. Bytes Lower Limit") -> w9
      case (w9) {
        frame False, Default {
          w10 = FALSE
          w11 = FALSE
          w12 = default
        }
        frame True {
          Search Or Split String(search string/char=$"RF Serial Number to match", string=w8) -> (match + rest of string=w13, substring before match=w14)
          String Subset(length (rest)=11, offset (0)=0, string=w13) -> w15
          Is Equal(x=w15, y=$"RF Serial Number to match") -> w16
          String Subset(length (rest)=2, offset (0)=0, string=w14) -> w17
          Is Equal(x=w17, y="ED") -> w18
          Search Or Split String(offset=21, search string/char="Extended Protocol:", string=w13) -> (match + rest of string=w12)
          String Subset(length (rest)=2, offset (0)=22, string=w12) -> w19
          Is Equal(x=w19, y=$"Message Type to Match") -> w20
          Logical And(w18, w16, w20) -> w10
          w11 = w10
        }
      }
      Is Greater(x=i1, y=50) -> w21
      Logical Or(w10, w21) -> w22
      stop if w22
    }
    stop if w10
  }
  $"VISA Out" <- w6
  $Error_Out <- w7
  $"Correct ED Message Type Received from Specified Serial" <- w11
  $"Extended Message Portion" <- w12
