vi "Function.gvi"   [LabVIEW NXG 4.0.0]
panel controls:
  "data_2": bool
  "stop": bool
uses:
  NI::DAQmx::Internal::DAQmx Create Channel (DO-Digital Output).gvi
  NI::DAQmx::Internal::DAQmx Start Task.gvi
  NI::DAQmx::Internal::DAQmx Write (Digital Bool 1Line 1Point).gvi
diagram:
  call "DAQmx Create Channel (DO-Digital Output).gvi"(lines="cDAQ1Mod5/port0/line0") -> (task out=w1, error out=w2)
  call "DAQmx Start Task.gvi"(task in=w1, error in=w2) -> (task out=w3, error out=w4)
  while {
    call "DAQmx Write (Digital Bool 1Line 1Point).gvi"(task in=w3, error in=w4, data=$data_2)
    stop if $stop
  }
