vi "GenerateRandomValues.gvi"   [LabVIEW NXG 4.0.0]
outputs:
  "ElementForBuildArray": i64[]
  "Sent (Parity)": i64[]
  "SentParityToCluster": i64[]
  "Sent": i64[]
  "MSB": i64
  "LSB": i64
uses:
  NI::G Core::Numeric::Random Number (Range) I64.gvi
diagram:
  call "Random Number (Range) I64.gvi"(upper bound=255, lower bound=0) -> (number=w1)
  call "Random Number (Range) I64.gvi"(upper bound=255, lower bound=0) -> (number=w2)
  Build Array(w1, w2) -> w3
  $ElementForBuildArray <- w3
  Logical And(w3, [127, 255]) -> w4
  Array Index(array=w4) -> (out0[0]=w5)
  $MSB <- w5
  Array Index(array=w4) -> (out0[1]=w6)
  $LSB <- w6
  $Sent <- w3
  $"Sent (Parity)" <- w4
  $SentParityToCluster <- w4
