vi "GenrateAndWrite.gvi"   [LabVIEW NXG 4.0.0]
panel indicators:
  "Output": string[]
diagram:
  # 00000002
  s1 = 300  # shift register
  for (N = 10000) {
    Add(s1, 1) -> w2
    Format Value(format string="%08D", value=w2) -> (output string=w3)
    append w3 to w1
    next s1 = w2
  }
  $Output <- w1
  Build Path(base path=path "\\EI-Data1\\Users\\JoeDaly\\Desktop", name or relative path="Test10.csv") -> (appended path=w4)
  Open Or Create Or Replace File(file path (use dialog)=w4, operation (0:open)="open or create") -> (refnum out=w5)
  Write To Text File(file (use dialog)=w5, text=w1)
