vi "Main.gvi"   [LabVIEW NXG 4.0.0]
panel controls:
  "Zero Cal": bool
  "Piezo Check": bool
  "Smoke Cal": bool
  "Reset test environment": bool
  "Port Selector": "VISA Instr" = "COM3"
  "Tab": i32
  "Application Change Log": string[] = ["V_0.4.0.0 : Addition of Report reader. ", "V_0.3.0.0 : Test Environment with new report structure ", "V_0.2.0.0 : Initial Deployment of test environment.", "V_0.1.0.0 : Initial trial of serial number allocation. "]
  "Reset Serial number": bool
  "stop_2": bool
  "Password": string
  "Cluster": T1
  "Submit Report": bool
  "Submit Report_2": bool
  "Read Report": bool
  "Test Report ID": string
  "Programmer": T2 = "PICkit 1 "
  "Supply Power to DUT": bool
  "Choose Hex File": path = path "C:\\Ei600JoeRevA.hex"
  "PIC ID": string = "16LF18326"
  "Program": bool
  "RunCommLiNKAuto": bool
  "RF Dongle In": "VISA Instr" = "COM11"
  "S1": string = "CF"
  "S2": string = "CF"
  "S3": string = "CF"
  "S4": string = "0B"
  "Command / Request": enum{"Request", "Command"} = "Request"
  "Stop CommsLINK": bool
  "Read EEPROM": bool
  "1st Byte = Start location, 2nd byte = number of bytes to read": u32[]
  "ApplySmokeCalApproximation": bool
  "Interrogate": bool
  "Tab_2": i32
  "Request": T8 = "Head Status Data"
  "Command/Request": enum{"Request", "Command"} = "Request"
  "S1.": string = "CF"
  "S2.": string = "CF"
  "S3.": string = "CF"
  "S4.": string = "0B"
  "error in": error
  "Custom Message 1": T14 = {"Message Code"="ED", "Length"="E3", "Repeat Level"="F0", "S1"="00", "S2"="00", "S3"="00", "S4"="00", "Ex1"="00", "Ex2"="00", "Ex3"="00", "Ex4"="00", "Type"="Extended"}
  "Chirp": bool
  "Piezo Control": bool
  "End Piezo Control": bool
  "Piezo Restart": bool
  "CO Alarm": bool
  "Fire Alarm": bool
  "Custom Message 1_2": bool
  "Cus Mes 2": bool
  "Cancel": bool
  "Cus Mes 3": bool
  "Cust Mess 4": bool
  "Custom Message 3": T14 = {"Message Code"="ED", "Length"="E3", "Repeat Level"="F0", "S1"="00", "S2"="00", "S3"="00", "S4"="00", "Ex1"="00", "Ex2"="00", "Ex3"="00", "Ex4"="00", "Type"="Extended"}
  "Custom Message 2": T14 = {"Message Code"="ED", "Length"="E3", "Repeat Level"="F0", "S1"="00", "S2"="00", "S3"="00", "S4"="00", "Ex1"="00", "Ex2"="00", "Ex3"="00", "Ex4"="00", "Type"="Extended"}
  "Custom Message 4": T14 = {"Message Code"="ED", "Length"="E3", "Repeat Level"="F0", "S1"="00", "S2"="00", "S3"="00", "S4"="00", "Ex1"="00", "Ex2"="00", "Ex3"="00", "Ex4"="00", "Type"="Extended"}
  "Revision History": string[] = ["14/05/2020V_0.4.0.0: fix for UART closing in CommsLINK Auto Test, also fix for serial filtering on CommsLINK tests.  ", "22/05/2020V_0.6.0.0: Fix for SMoke Cal approximation ", "22/05/2020V_0.8.0.0: SMoke Cal approximation multiplication factor made a variable on front panel "]
  "Idle in Test mode": bool = TRUE
  "ipeVersion": string = "5.35"
  "SmokeMultiplyFactor": f64 = 2.1
  "Display Pinouts": bool
  "Image Button_2": bool
  "Idle in Test mode_2": bool = TRUE
  "Password_2": string
panel indicators:
  "User ID Received": bool
  "User id": u8[]
  "error out_2": error
  "loop iteration_2": i32
  "Test Mode ACK": bool
  "error out": error
  "loop iteration": i32
  "zero cal response": u8[]
  "Result": bool
  "Frequency": u8
  "Zero Cal Pass": bool
  "Smoke Cal Pass": bool
  "Zero Cal MSB & LSB (Hex)": u8[]
  "Smoke Cal MSB & LSB (Hex)": u8[]
  "Zero Cal (Dec)": u16
  "Smoke Cal (Dec)": u64
  "ACK (Z.C.)": bool
  "Smoke Cal ACK": u8[]
  "ACK (S.C.)": bool
  "Smoke Cal response_2": u8[]
  "Zero Cal Results": string
  "Smoke Cal Result": string
  "Test Environment Active": f64
  "Serial Number": u8[]
  "Square LED": bool
  "Square LED_2": bool
  "Smoke Cal measurements": u16[]
  "Zero Cal measurements": u16[]
  "New serial number": u8[]
  "Output_2": error
  "New Unit": bool
  "Serial Assigned": bool
  "assigned serial number": u8[]
  "error out_3": error
  "Report ID": string
  "Smoke Plot": f64
  "min value": i64
  "max value": i64
  "Program DUT": string
  "Square LED_3": bool
  "standard output_2": string
  "created cluster": T3
  "Individual Results": bool[]
  "Detailed Results": T5[]
  "Output_4": T5
  "Test Flag results": T6
  "EEPROM Read Responce": u8[]
  "HEX": u32[]
  "HEX (Parity Adjusted)": i64[]
  "DEC": u16
  "BIN": i32
  "Bit Array": bool[]
  "Head Status Results": T7
  "Current Indication Results": T9
  "Head Type Results": T10
  "End Of Life Results": T11
  "Temperature Result": cluster{"Temperature": i32}
  "Smoke Percentage Results": cluster{"Smoke Percentage": i32}
  "Alarm Information Results": T12
  "Dust Timer MSB Result": cluster{"Dust Timer MSB": i32}
  "Dust Timer LSB Result": cluster{"Dust Timer LSB": i32}
  "Dust Status Request Results": T13
  "Current Test": T8
  "RF Response Received": bool
  "In Progress": bool
  "RF Message Received_3": bool
  "Response HEX": string
  "Response": string
  "Ready to Send / Interrogate": bool
  "Square LED_4": bool
  "error in_2": error
  "loop iteration_3": i32
  "loop iteration_4": i32
  "Square LED_5": bool
  "Serial Number_2": u8[]
  "error out_4": error
  "error in_3": error
types:
  T1 = cluster{"Test Case/Numbers": string, "Test Description ": string, "Product / Varient": string, "Report ID": string, "Actionee": string, "Start date/Time": string, "End of test date/time": string, "Date of report": string, "Reference Standard": string, "Actionee Comments": string, "Hardware Revision ": string, "Software Revision ": string, "Serial Number": string, "Voltage (V)": string, "UCL (V)": string, "LCL (V)": string, "Current (A)": string, "UCL (mA)": string, "LCL (mA)": string, "Time (s)": string, "UCL (s)": string, "LCL (s)": string, "Resistance (Ω)": string, "UCL (Ω)": string, "LCL (Ω)": string, "Range (Meters) ": string, "UCL (Meters)": string, "LCL (Meters)": string, "Center frequency (MHz)": string, "UCL (MHz)": string, "LCL (MHz)": string, "Power (-dBm)": string, "UCL (-dBm)": string, "LCL (-dBm)": string, "Gas Level (ppm)": string, "UCL (ppm)": string, "LCL (ppm)": string, "Result": string, "Hardware Revision_2": string}
  T2 = enum{"PICkit 1 ", "PICkit 2 ", "PICkit 3 ", "PICkit 4"}
  T3 = cluster{"Element 2": string, "Element 3": string, "Element 4": string, "Element 5": string, "Element 6": string, "Element 7": string, "Element 8": string, "Element 9": string, "Element 10": string, "Element 11": string, "Element 12": string, "Element 13": string, "Element 14": string, "Element 15": string, "Element 16": string, "Element 17": string, "Element 18": string, "Element 19": string, "Element 20": string, "Element 21": string, "Element 22": string, "Element 23": string, "Element 24": string, "Element 25": string, "Element 26": string, "Element 27": string, "Element 28": string, "Element 29": string, "Element 30": string, "Element 31": string, "Element 32": string, "Element 33": string, "Element 34": string, "Element 35": string, "Element 36": string, "Element 37": string, "Element 38": string, "Element 39": string, "Element 1": string}
  T4 = enum{"Head Status Data", "Current Indication Data", "Head ID MS Word", "Head ID LS Word", "Type", "EOL", "Temp", "Alarm Information", "Smoke Percentage", "Stop"}
  T5 = cluster{"UART ACK": bool, "Test Step": T4, "ED Message Rx": bool, " Test Pass": bool, "No RF response received": bool, "Sent": i64[], "Sent (Parity)": i64[], "Returned": u32[], "Returned (Parity)": i64[], "RF Serial Number": string, "Signal Strength": i32, "Type (Byte)": string, "Test (Byte)": string, "Test (Name)": string}
  T6 = cluster{"Overall Result": bool, "Head ID MS Word": bool, "Current Indication Data": bool, "Alarm Information ": bool, "Temp ": bool, "Head ID LS Word": bool, "Head Status Data ": bool, "EOL": bool, "Type ": bool, "Smoke Percentage": bool}
  T7 = cluster{"Head Fault": bool, "Low Batt Flag": bool, "EOL Flag": bool, "Tamper": bool, "Battery Voltage": f64, "Dust Level": i32}
  T8 = enum{"Head Status Data", "Current Indication Data", "Head ID MS Word", "Head ID LS Word", "Type", "EOL", "Temp", "Alarm Information", "Smoke Percentage", "Dust Status Request", "Dust Timer MSB Request ", "Dust Timer LSB Request "}
  T9 = cluster{"Test": bool, "Hush": bool, "Alarm Mem": bool, "Dusty Chamber": bool, "EOL": bool, "Sensor Fault": bool, "Low Batt": bool, "AudioLINK": bool, "Piezo Control": bool, "IC Alarm": bool, "Local Alarm": bool, "Standby": bool}
  T10 = cluster{"AudioLINK": bool, "Battery Level": bool, "Dust Compensation": bool, "CO Sensor": bool, "Heat Sensor": bool, "Optical Sensor": bool, "Ionisation Sensor": bool, "Head Type": string}
  T11 = cluster{"EOL (Years)": f64, "EOL (Days)": f64, "EOL Count (4 hour)": i32}
  T12 = cluster{"Smoke Level": string, "Multi-Criteria Alarm": bool, "Optical Gain Setting": bool, "Heat Alarm": string}
  T13 = cluster{"Supports LED Compensation": bool, "Dust Level Valid": bool, "LED Compensation Active": bool, "Max Dust Level": i32, "Current Dust Level": i32}
  T14 = cluster{"Message Code": string, "Length": string, "Repeat Level": string, "S1": string, "S2": string, "S3": string, "S4": string, "Ex1": string, "Ex2": string, "Ex3": string, "Ex4": string, "Type": enum{"Extended", "Standard"}}
uses:
  NI::VISA::Close (Instr).gvi
  NI::VISA::Open (Instr).gvi
  NI::VISA::Configure Serial Port (Instr).gvi
  NI::VISA::Read (Instr, Bytes).gvi
  NI::VISA::Flush Buffer (Instr).gvi
  NI::VISA::Write (Instr, Bytes).gvi
  600SeriesTestEnvironment::Confirm test mode entry ack.gvi
  600SeriesTestEnvironment::ReadSerialNumber.gvi
  600SeriesTestEnvironment::WriteNewSerialNumber.gvi
  600SeriesTestEnvironment::ExtendedMessageBuildStart.gvi
  600SeriesTestEnvironment::CaptureSmokeCal.gvi
  NI::G Core::Error::Clear Error Cluster.gvi
  600SeriesTestEnvironment::ApplySmokeCalApproximation.gvi
  600SeriesTestEnvironment::CaptureZeroCal.gvi
  600SeriesTestEnvironment::Sounder.gvi
  600SeriesTestEnvironment::ResetSerial.gvi
  600SeriesTestEnvironment::ReadNewReportID.gvi
  600SeriesTestEnvironment::ValidationReportReader.gvi
  600SeriesTestEnvironment::Programmer.gvi
  600SeriesTestEnvironment::CommsLINKAutoTest.gvi
  600SeriesTestEnvironment::EEPROMRead.gvi
  600SeriesTestEnvironment::CommsLINK Request_streamline_2.gvi
  600SeriesTestEnvironment::SendCommandReceiveResponse.gvi
  600SeriesTestEnvironment::SendCommandNoResponse.gvi
  600SeriesTestEnvironment::CustomExtendedRFMessage.gvi
  600SeriesTestEnvironment::ContinuousTestMode.gvi
diagram:
  while (iteration -> i1) {
    Is Equal To 0(x=i1) -> w1
    while (iteration -> i2) {
      $"Test Mode ACK" <- FALSE
      # check user ID
      case (w1) {
        frame False, Default {
          w2 = default
          w3 = $"Port Selector"
        }
        frame True {
          call "Close (Instr).gvi"(session in=$"Port Selector") -> (error out=w2)
          w3 = $"Port Selector"
        }
      }
      call "Open (Instr).gvi"(resource name=w3, error in=w2) -> (session out=w4, error out=w5)
      call "Configure Serial Port (Instr).gvi"(session in=w4, error in=w5, baud rate=19200, enable termination char=FALSE) -> (session out=w6, error out=w7)
      call "Read (Instr, Bytes).gvi"(session in=w6, error in=w7, byte count=11) -> (session out=w8, error out=w9, read buffer=w10)
      $"error out_2" <- w9
      $"User id" <- w10
      $"Detailed Results" <- T5[] []
      Is Equal(x=w10, y=[0, 85, 8, 58, 16, 70, 16, 97, 127, 181, 222]) -> w11
      Array Index(array=w11) -> (out0[0]=w12, out1[1]=w13)
      Logical And(w12, w13) -> w14
      $"User ID Received" <- w14
      $"Square LED" <- TRUE
      $"Square LED_2" <- TRUE
      w15 = $"Submit Report_2"
      Logical Or(w14, w15) -> w16
      $"loop iteration_2" <- i2
      Property Node(instance in=reference to "Square LED_2", "Visible"=FALSE)
      Property Node(instance in=reference to "Square LED", "Visible"=FALSE)
      Property Node(instance in=reference to "Password", "Value"="")
      $"Test Flag results" <- T6 {all zero or empty}
      Property Node(instance in=reference to "Reset Serial number", "Disabled"=TRUE)
      Property Node(instance in=reference to "Test Environment Active", "Visible"=FALSE)
      $"Report ID" <- ""
      $"New Unit" <- FALSE
      $"Serial Assigned" <- FALSE
      Property Node(instance in=reference to "Square LED_4", "Visible"=FALSE)
      Property Node(instance in=reference to "Square LED_3", "Visible"=FALSE)
      stop if w16
    }
    case (w14) {
      frame False, Default {
        w17 = w8
        w18 = default
        w19 = default
      }
      frame True {
        call "Flush Buffer (Instr).gvi"(session in=w8) -> (session out=w20)
        for (N = 1) {
          call "Write (Instr, Bytes).gvi"(session in=w20, write buffer=[0, 85, 3, 84, 251, 129]) -> (session out=w21, error out=w22)
        }
        while (iteration -> i3) {
          call "Confirm test mode entry ack.gvi"(Input=w21, Input_2=w22) -> (Output=w17, Output_2=w19, error out=w18, Output_3=w23)
          $"Test Mode ACK" <- w19
          $"error out" <- w23
          Is Greater Than 0(x=i3) -> w24
          Logical Or(w19, w24) -> w25
          $"loop iteration" <- i3
          stop if w25
        }
      }
    }
    case (w15) {
      frame False, Default {
        w26 = w19
      }
      frame True {
        w26 = w15
      }
    }
    case (TRUE) {
      frame False, Default {
        w27 = w17
        w28 = w26
      }
      frame True {
        call "ReadSerialNumber.gvi"(session reference=w17, error in=w18) -> (session out=w29, Serial Number=w30, error out=w31)
        $"Serial Number" <- w30
        Is Equal(x=w30, y=[0, 0, 0, 0]) -> w32
        Array Index(array=w32) -> (out0[0]=w33, out1[1]=w34, out2[2]=w35, out3[3]=w36)
        Logical And(w33, w34, w35, w36) -> w37
        call "WriteNewSerialNumber.gvi"(session in=w29, error in=w31, selector=w37) -> (Output=w27, Output_2=w38, EEPROM Write response=w39)
        $Output_2 <- w38
        $"New Unit" <- w37
        Array Subset(array=w39, index0=6, length0=4) -> w40
        $"New serial number" <- w40
        Is Equal(x=w39, y=0x0) -> w41
        Array Index(array=w41) -> (out0[0]=w42, out1[1]=w43, out2[2]=w44, out3[3]=w45)
        Logical And(w42, w43, w44, w45) -> w46
        Not(x=w46) -> w47
        case (w47) {
          frame True { }
          frame False {
            $"Serial Number" <- w40
          }
        }
        Logical And(w47, w37) -> w48
        $"Serial Assigned" <- w48
        w28 = w26
      }
    }
    case (w28) {
      frame False, Default {
        w49 = default
      }
      frame True {
        s1 = FALSE  # shift register
        while (iteration -> i4) {
          w50 = $"RF Dongle In"
          Build Cluster(w50, $"error in", $"Custom Message 1")
          Build Cluster(w50, $"error in", $"Custom Message 2")
          w51 = $"S1."
          w52 = $"S2."
          w53 = $"S3."
          w54 = $"S4."
          call "RFSerialString.gvi"(S1=w51, S2=w52, S3=w53, S4=w54) -> (RF Serial=w55)
          call "ExtendedMessageBuildStart.gvi"(S1=w51, S2=w52, S3=w53, S4=w54) -> (Output=w56)
          Build Cluster(w50, $"error in", w55, w56) -> w57
          Build Cluster(w50, $"error in", $"Custom Message 4") -> w58
          event {
            on "Smoke Cal" Value changed {
              for (N = 1) {
                call "Flush Buffer (Instr).gvi"(session in=w27, mode="Discard Receive and Transmit Buffers"(192)) -> (session out=w63, error out=w64)
                call "Write (Instr, Bytes).gvi"(session in=w63, error in=w64, write buffer=[0, 85, 3, 55, 167, 68]) -> (session out=w65, error out=w66)
              }
              while {
                Property Node(instance in=reference to "Square LED", "Visible"=FALSE) -> (error out=w67)
                Property Node(instance in=reference to "Square LED", "Visible"=TRUE, error in=w67)
                call "Read (Instr, Bytes).gvi"(session in=w65, error in=w66, byte count=6) -> (session out=w68, error out=w69, read buffer=w70)
                $"Smoke Cal ACK" <- w70
                Array Index(array=w70) -> (out0[3]=w71)
                Is Equal(x=w71, y=0xFF) -> w72
                $"ACK (S.C.)" <- w72
                stop if w72
              }
              while {
                call "Read (Instr, Bytes).gvi"(session in=w68, error in=w69, byte count=11) -> (session out=w73, error out=w74, read buffer=w75)
                $"Smoke Cal response_2" <- w75
                Array Index(array=w75) -> (out0[3]=w76)
                Is Equal(x=w76, y=0x37) -> w77
                stop if w77
              }
              Array Subset(array=w75, index0=5, length0=2) -> w78
              $"Smoke Cal MSB & LSB (Hex)" <- w78
              call "CaptureSmokeCal.gvi"(Input=w73, Input_2=w74) -> (session out=w60, error out=w61, SmokeCalForGraph=w79)
              $"Smoke Cal measurements" <- w79
              Array Index(array=w75) -> (out0[6]=w80)
              Array Index(array=w75) -> (out0[5]=w81)
              Multiply(w81, 256) -> w82: u64
              Add(w82, w80) -> w83
              $"Smoke Cal (Dec)" <- w83
              Array Index(array=w75) -> (out0[4]=w84)
              case (w84) {
                frame 240, Default {
                  w85 = "--"
                  w86 = TRUE
                }
                frame 15 {
                  w85 = "Outside limits "
                  w86 = FALSE
                }
                frame 30 {
                  w85 = "Ratio Failed"
                  w86 = FALSE
                }
                frame 14 {
                  w85 = "EEPROM Corrupt"
                  w86 = FALSE
                }
              }
              $"Smoke Cal Result" <- w85
              Property Node(instance in=reference to "Square LED", "Visible"=FALSE, error in=w61)
              $"Smoke Cal Pass" <- w86
              w59 = $"Smoke Cal"
              w62 = default
            }
            on "Zero Cal" Value changed {
              for (N = 1) {
                call "Flush Buffer (Instr).gvi"(session in=w27, mode="Discard Receive and Transmit Buffers"(192)) -> (session out=w87, error out=w88)
                call "Write (Instr, Bytes).gvi"(session in=w87, error in=w88, write buffer=[0, 85, 3, 54, 183, 101]) -> (session out=w89, error out=w90)
                Wait(time to wait=5000)
              }
              call "Read (Instr, Bytes).gvi"(session in=w89, error in=w90, byte count=15) -> (session out=w91, error out=w92, read buffer=w93)
              $"zero cal response" <- w93
              Array Subset(array=w93, index0=11, length0=2) -> w94
              $"Zero Cal MSB & LSB (Hex)" <- w94
              Array Index(array=w93) -> (out0[12]=w95)
              Array Index(array=w93) -> (out0[11]=w96)
              Multiply(w96, 256) -> w97: u64
              Add(w97, w95) -> w98
              $"Zero Cal (Dec)" <- w98
              call "Clear Error Cluster.gvi"(error in=w92) -> (error out=w99)
              call "ApplySmokeCalApproximation.gvi"(session in=w91, error in=w99, ZeroCalIn=w94, ApplySmokeCalApproximation=$ApplySmokeCalApproximation, SmokeMultiplyFactor=$SmokeMultiplyFactor) -> (session out=w100, error out=w101)
              call "CaptureZeroCal.gvi"(Input=w100, Input_2=w101) -> (session out=w60, error out=w61, ZeroCalForGraph=w102)
              Property Node(instance in=reference to "Square LED_2", "Visible"=FALSE, error in=w61)
              Property Node(instance in=reference to "Square LED_2", "Visible"=FALSE) -> (error out=w103)
              Property Node(instance in=reference to "Square LED_2", "Visible"=TRUE, error in=w103)
              Array Index(array=w93) -> (out0[10]=w104)
              case (w104) {
                frame 240, Default {
                  w105 = "--"
                  w106 = TRUE
                }
                frame 15 {
                  w105 = "Outside limits "
                  w106 = FALSE
                }
                frame 14 {
                  w105 = "EEPROM Corrupt"
                  w106 = FALSE
                }
              }
              $"Zero Cal Results" <- w105
              Is Greater Or Equal(x=w98, y=500) -> w107
              Logical And(w107, w106) -> w108
              $"Zero Cal Pass" <- w108
              $"Zero Cal measurements" <- w102
              Array Index(array=w93) -> (out0[3]=w109)
              Is Equal(x=w109, y=0xFF) -> w110
              $"ACK (Z.C.)" <- w110
              w59 = $"Zero Cal"
              w62 = default
            }
            on "Piezo Check" Value changed {
              call "Flush Buffer (Instr).gvi"(session in=w27, mode="Discard Receive and Transmit Buffers"(192)) -> (session out=w111)
              call "Sounder.gvi"(session reference=w111) -> (Output=w60, error out=w61, sounder result=w112, element=w113)
              $Result <- w112
              $Frequency <- w113
              w59 = $"Piezo Check"
              w62 = default
            }
            on "Reset Serial number" Value changed {
              call "ResetSerial.gvi"(resource name=w27) -> (session out=w60, error out_4=w61, EEPROM Read response=w114)
              $"assigned serial number" <- w114
              w59 = $"Reset Serial number"
              w62 = default
            }
            on "Submit Report" Value changed {
              call "ReadNewReportID.gvi"() -> (Report ID Number allocated=w115)
              $"Report ID" <- w115
              w116 = path "\\ei-data1\\Global\\Joe Daly\\600seriesLabviewLink\\TestReports"
              Build Path(base path=w116, name or relative path=w115) -> (appended path=w117)
              Open Or Create Or Replace File(file path (use dialog)=w117, operation (0:open)="open or create") -> (refnum out=w118)
              Property Node(instance in=$Cluster, "Report ID"=w115) -> (instance out=w119)
              Flatten To JSON(anything=w119) -> (JSON string=w120)
              Search And Replace String(input string=w120, multiline? (F)=TRUE, replace all (F)=TRUE, search string="\"") -> (result string=w121)
              Search And Replace String(input string=w121, multiline? (F)=TRUE, replace all (F)=TRUE, replace string ("")="\r\n", search string=",") -> (result string=w122)
              # Logs manual tests in standard format.
              Search And Replace String(input string=w122, multiline? (F)=TRUE, replace all (F)=TRUE, search string="{") -> (result string=w123)
              Search And Replace String(input string=w123, multiline? (F)=TRUE, replace all (F)=TRUE, search string="}") -> (result string=w124)
              Write To Text File(file (use dialog)=w118, text=w124)
              w59 = $"Submit Report"
              w60 = default
              w61 = default
              w62 = default
            }
            on "Read Report" Value changed {
              call "ValidationReportReader.gvi"(Test Report ID=$"Test Report ID") -> (created cluster=w125, min value=w126, max value=w127, error out=w128)
              $"created cluster" <- w125
              $"min value" <- w126
              $"max value" <- w127
              call "Clear Error Cluster.gvi"(error in=w128)
              w59 = $"Read Report"
              w60 = default
              w61 = default
              w62 = default
            }
            on "Program" Value changed {
              Property Node(instance in=reference to "Square LED_3", "Visible"=TRUE) -> (error out=w129)
              call "Programmer.gvi"(Programmer=$Programmer, Supply Power to DUT=$"Supply Power to DUT", Choose Hex File=$"Choose Hex File", PIC ID=$"PIC ID", ipeVersion=$ipeVersion, Error=w129) -> (Program DUT=w130, Square LED=w131, standard output_2=w132, Output=w133)
              $"Program DUT" <- w130
              $"Square LED_3" <- w131
              $"standard output_2" <- w132
              call "ReadSerialNumber.gvi"(session reference=w27) -> (Serial Number=w134, error out=w135)
              $"Serial Number_2" <- w134
              Property Node(instance in=reference to "Square LED_3", "Visible"=FALSE, error in=w133)
              $"error out_4" <- w135
              w59 = $Program
              w60 = default
              w61 = default
              w62 = default
            }
            on "RunCommLiNKAuto" Value changed {
              Property Node(instance in=reference to "Square LED_4", "Visible"=TRUE) -> (error out=w136)
              call "CommsLINKAutoTest.gvi"(UART In=w27, RF Dongle In=w50, Test Results=T5 {all zero or empty}, S1=$S1, S2=$S2, S3=$S3, S4=$S4, Command / Request=$"Command / Request", Stop CommsLINK=$"Stop CommsLINK", UART In_2=w136) -> (Output=w137, Individual Results=w138, Overall Result=w139, Head ID MS Word=w140, Current Indication Data=w141, Alarm Info=w142, Temp=w143, Head ID LS Word=w144, Head Status Data=w145, EOL=w146, Type=w147, Smoke Percentage=w148, error in=w149)
              $"Detailed Results" <- w137
              Property Node(instance in=reference to "Square LED_4", "Visible"=FALSE, error in=w149)
              Reverse 1D Array(array=w138) -> (reversed array=w150)
              $"Individual Results" <- w150
              Build Cluster(w139, w140, w141, w142, w143, w144, w145, w146, w147, w148) -> w151
              $"Test Flag results" <- w151
              $"Square LED_4" <- TRUE
              w59 = $RunCommLiNKAuto
              w60 = default
              w61 = default
              w62 = default
            }
            on "Read EEPROM" Value changed {
              call "EEPROMRead.gvi"(resource name=w27, Bytes to read=$"1st Byte = Start location, 2nd byte = number of bytes to read") -> (session out=w60, error out_4=w61, EEPROM Read Responce=w152)
              $"EEPROM Read Responce" <- w152
              w59 = $"Read EEPROM"
              w62 = default
            }
            on "Interrogate" Value changed {
              call "CommsLINK Request_streamline_2.gvi"(RF Dongle Tx=w50, S1=w51, S2=w52, S3=w53, S4=w54, Command / Request=$"Command/Request", Request=$Request) -> (HEX=w153, HEX (Parity Adjusted)=w154, DEC=w155, BIN=w156, Bit Array=w157, RF Message Received=w158, Head Status Results=w159, Current Indication Results=w160, Head Type Results=w161, End Of Life Results=w162, Temperature Result=w163, Smoke Percentage Results=w164, Alarm Information Results=w165, Dust Timer MSB Result=w166, Dust Timer LSB Result=w167, Dust Status Request Results=w168, Current Test=w169)
              $HEX <- w153
              $"HEX (Parity Adjusted)" <- w154
              $DEC <- w155
              $BIN <- w156
              $"Bit Array" <- w157
              $"RF Response Received" <- w158
              $"Head Status Results" <- w159
              $"Current Indication Results" <- w160
              Property Node(instance in=reference to "RF Message Received_3", "Visible"=w158) -> (error out=w170)
              Property Node(instance in=reference to "RF Message Received_3", "Visible"=TRUE, error in=w170)
              $"Head Type Results" <- w161
              $"End Of Life Results" <- w162
              $"In Progress" <- TRUE
              $"Temperature Result" <- w163
              $"Ready to Send / Interrogate" <- FALSE
              Property Node(instance in=reference to "RF Message Received_3", "Visible"=TRUE)
              $"Smoke Percentage Results" <- w164
              $"Alarm Information Results" <- w165
              $"Dust Timer MSB Result" <- w166
              $"Dust Timer LSB Result" <- w167
              $"Dust Status Request Results" <- w168
              $"Current Test" <- w169
              w59 = $Interrogate
              w60 = default
              w61 = default
              w62 = default
            }
            on "Piezo Control" Value changed {
              call "SendCommandReceiveResponse.gvi"(cluster in=w57, Test Code="38") -> (Response HEX=w171, Response=w172, Ready to Send=w173)
              $"Response HEX" <- w171
              $Response <- w172
              $"Ready to Send / Interrogate" <- w173
              $"In Progress" <- TRUE
              w59 = $"Piezo Control"
              w60 = default
              w61 = default
              w62 = default
            }
            on "End Piezo Control" Value changed {
              call "SendCommandReceiveResponse.gvi"(cluster in=w57, Test Code="C4") -> (Response HEX=w174, Response=w175, Ready to Send=w176)
              $"Response HEX" <- w174
              $Response <- w175
              $"Ready to Send / Interrogate" <- w176
              $"In Progress" <- TRUE
              w59 = $"End Piezo Control"
              w60 = default
              w61 = default
              w62 = default
            }
            on "Piezo Restart" Value changed {
              call "SendCommandReceiveResponse.gvi"(cluster in=w57, Test Code="49") -> (Response HEX=w177, Response=w178, Ready to Send=w179)
              $"Response HEX" <- w177
              $Response <- w178
              $"Ready to Send / Interrogate" <- w179
              $"In Progress" <- TRUE
              w59 = $"Piezo Restart"
              w60 = default
              w61 = default
              w62 = default
            }
            on "Chirp" Value changed {
              call "SendCommandNoResponse.gvi"(cluster in=w57, Test Code="62")
              $"In Progress" <- TRUE
              w59 = $Chirp
              w60 = default
              w61 = default
              w62 = default
            }
            on "Cancel" Value changed {
              call "SendCommandNoResponse.gvi"(cluster in=w57, Test Code="94")
              $"In Progress" <- TRUE
              w59 = $Cancel
              w60 = default
              w61 = default
              w62 = default
            }
            on "CO Alarm" Value changed {
              call "SendCommandNoResponse.gvi"(cluster in=w57, Test Code="34")
              $"In Progress" <- TRUE
              w59 = $"CO Alarm"
              w60 = default
              w61 = default
              w62 = default
            }
            on "Fire Alarm" Value changed {
              call "SendCommandNoResponse.gvi"(cluster in=w57, Test Code="C2")
              $"In Progress" <- TRUE
              w59 = $"Fire Alarm"
              w60 = default
              w61 = default
              w62 = default
            }
            on "Custom Message 1_2" Value changed {
              call "CustomExtendedRFMessage.gvi"(cluster in=w58)
              $"In Progress" <- TRUE
              w59 = $"Custom Message 1_2"
              w60 = default
              w61 = default
              w62 = default
            }
            on "Cus Mes 2" Value changed {
              call "CustomExtendedRFMessage.gvi"(cluster in=w58)
              $"In Progress" <- TRUE
              w59 = $"Cus Mes 2"
              w60 = default
              w61 = default
              w62 = default
            }
            on "Cus Mes 3" Value changed {
              call "CustomExtendedRFMessage.gvi"(cluster in=w58)
              $"In Progress" <- TRUE
              w59 = $"Cus Mes 3"
              w60 = default
              w61 = default
              w62 = default
            }
            on "Cust Mess 4" Value changed {
              call "CustomExtendedRFMessage.gvi"(cluster in=w58)
              $"In Progress" <- TRUE
              w59 = $"Cust Mess 4"
              w60 = default
              w61 = default
              w62 = default
            }
            on "Idle in Test mode" Value changed {
              while (iteration -> i5) {
                call "ContinuousTestMode.gvi"(loop iteration_3=i5, Input=w27) -> (Time until test mode re-entry message=w180, error in_2=w181)
                $"Test Environment Active" <- w180
                $"error in_2" <- w181
                w182 = $"Idle in Test mode"
                Wait(time to wait=1000)
                Is Equal(x=$Password, y="password-1") -> w183
                Not(x=w183) -> w184
                Property Node(instance in=reference to "Reset Serial number", "Disabled"=w184)
                stop if w182
              }
              w59 = w182
              w60 = default
              w61 = default
              w62 = default
            }
            on "Reset test environment" Value changed {
              w59 = $"Reset test environment"
              w60 = default
              w61 = default
              w62 = $"Reset test environment"
            }
            on "Display Pinouts" Value changed {
              Property Node(instance in=reference to "Display Pinouts", "Visible"=TRUE)
              w59 = $"Display Pinouts"
              w60 = default
              w61 = default
              w62 = default
            }
          }
          call "Clear Error Cluster.gvi"(error in=w61) -> (error out=w185)
          Build Cluster(w50, $"error in", $"Custom Message 3")
          Property Node(instance in=reference to "Test Environment Active", "Visible"=TRUE)
          Property Node(instance in=reference to "Square LED_3", "Visible"=FALSE)
          Property Node(instance in=reference to "Display Pinouts", "Visible"=FALSE)
          $"loop iteration_3" <- i4
          $"Ready to Send / Interrogate" <- TRUE
          Wait(time to wait=1000)
          $"In Progress" <- FALSE
          $"RF Message Received_3" <- FALSE
          $"Response HEX" <- ""
          $Response <- ""
          w186 = $stop_2
          Logical Or(w186, w62) -> w187
          next s1 = w59
          stop if w187
        }
        call "Close (Instr).gvi"(session in=w60, error in=w185) -> (error out=w188)
        $"error out_3" <- w188
        while (iteration -> i6) {
          call "ContinuousTestMode.gvi"(loop iteration_3=i6, Input=w27) -> (Time until test mode re-entry message=w189, error in_2=w190)
          $"Test Environment Active" <- w189
          $"error in_3" <- w190
          w191 = $"Idle in Test mode_2"
          Wait(time to wait=1000)
          Is Equal(x=$Password_2, y="password-1") -> w192
          Not(x=w192) -> w193
          Property Node(instance in=reference to "Reset Serial number", "Disabled"=w193)
          stop if w191
        }
        w49 = w186
      }
    }
    stop if w49
  }
