vi "ParseExtMessType.gvi"   [LabVIEW NXG 4.0.0]
inputs:
  "Input": string
outputs:
  "Ext Proto": string
  "Type (Byte)": string
  "Test (Byte)": string
  "selector": u32
  "String Input": string
diagram:
  Search Or Split String(offset=0, search string/char="Extended Protocol:", string=$Input) -> (match + rest of string=w1)
  $"Ext Proto" <- w1
  String Subset(length (rest)=2, offset (0)=19, string=w1) -> w2
  $"Type (Byte)" <- w2
  String Subset(length (rest)=2, offset (0)=22, string=w1) -> w3
  $"Test (Byte)" <- w3
  Hexadecimal String To Number(string=w3) -> (number=w4)
  $selector <- w4
  $"String Input" <- w1
