vi "ParseParityBytes.gvi"   [LabVIEW NXG 4.0.0]
inputs:
  "match and rest of string": string
  "TestTypeMatch": bool
  "Input_2": i64
  "Input": i64
outputs:
  "Returned_2": u32[]
  "Returned (Parity)_2": i64[]
  "overallResult": bool
  "Returned (Parity)": i64[]
  "Returned": u32[]
diagram:
  String Subset(length (rest)=2, offset (0)=28, string=$"match and rest of string") -> w1
  Hexadecimal String To Number(string=w1) -> (number=w2)
  String Subset(length (rest)=2, offset (0)=25, string=$"match and rest of string") -> w3
  Hexadecimal String To Number(string=w3) -> (number=w4)
  Build Array(w4, w2) -> w5
  $Returned_2 <- w5
  Logical And(w5, [127, 255]) -> w6
  $"Returned (Parity)_2" <- w6
  Array Index(array=w6) -> (out0[1]=w7)
  Is Equal(x=$Input, y=w7) -> w8
  Array Index(array=w6) -> (out0[0]=w9)
  Is Equal(x=$Input_2, y=w9) -> w10
  Logical And($TestTypeMatch, w10, w8) -> w11
  $overallResult <- w11
  $"Returned (Parity)" <- w6
  $Returned <- w5
