vi "Programmer.gvi"   [LabVIEW NXG 4.0.0]
# This Vi is used to program Microchip MCU’s from inside the labview platform.
inputs:
  "Programmer": T1 = "PICkit 1 "
  "Supply Power to DUT": bool
  "Choose Hex File": path = path "C:\\Ei600JoeRevA.hex"
  "PIC ID": string = "16LF18326"
  "Error": error
  "match and rest of string_2": string
  "ipeVersion": string = "5.35"
outputs:
  "Program DUT": string
  "Square LED": bool
  "standard output_2": string
  "Output": error
panel controls:
  "stop": bool
types:
  T1 = enum{"PICkit 1 ", "PICkit 2 ", "PICkit 3 ", "PICkit 4"}
uses:
  600SeriesTestEnvironment::SelectProgrammer.gvi
  600SeriesTestEnvironment::SupplyPowerToDUT.gvi
  NI::G Core::Libraries and Executables::System Exec.gvi
diagram:
  # The following commands are available in the command line interface:
  # Options
  # Description
  # Default
  # #
  # Communication Ports 1 through 255 supported. Com port 5 indicates USB and other Com ports indicate RS232.
  # 5
  # ?
  # Help Screen
  # Not Shown
  # A
  # VDDAPP  (Applicable only for MPLAB PM3)
  # Device specific
  # B<operation><path>
  # Environment Operation
  # Operation L: = Load environment,
  # All paths = full file path. All paths located on PM3Card must be preceded by a ‘P’ All paths on the computer must be preceded by a ‘C’.
  # Operation S: = Save environment,
  # All paths = full environment path. All paths located on PM3Card must be preceded by a ‘P’ All paths on the computer must be preceded by a ‘C’.
  # Operation D: Delete environment
  # All paths = full file path. All paths located on PM3Card must be preceded by a ‘P’ All paths on the computer must be preceded by a ‘C’
  # Operation C: Copy environment
  # Path = Full file path to the environment file of the environment to be copied followed by the path to the destination directory. The two paths must be separated by asterisk (*), and each path must be preceded by either ‘C’ if the path is on the computer or ‘P’ if the path is on the MPLAB PM3.
  # Operation V: = View environment
  # Path = full file path to the environment file of the environment file to be viewed. All paths located on the PM3Card must be preceded by ‘P’. All paths on the computer must be preceded by ‘C’.
  # None
  # C
  # Blank Check Device
  # Do Not Blank Check
  # D<file>
  # OSSuite file selection
  # None
  # E
  # Erase Flash Device
  # Do Not Erase
  # F<file>
  # Hex File Selection
  # None
  # G<Type><range/path>
  # Read functions:
  # Type F = read into hex file, path = full file path, range is not used.
  # Types P, E, I, C, B, A = output read of Program, EEPROM, ID, Configuration, Boot and Auxiliary Memory to the screen. P and E must be followed by an address range in the form of x-y where x is the start address and y is the end address both in hex, path is not used.
  # None
  # I
  # Display Device ID (Applicable only for MPLAB PM3)
  # Do Not Display
  # J
  # High Voltage MCLR (Not selected)
  # Selected
  # K
  # Display Hex File Checksum
  # Do Not Display
  # L
  # Low voltage programming (for devices that support PGM pin)
  # Not Selected
  # M<memory region>
  # Program Device Memory regions:
  # P = Program memory
  # E = EEPROM
  # I = ID memory
  # C = Configuration memory
  # A = Auxiliary memory
  # B = Boot memory
  # If no region is entered, the entire device will be programmed.
  # Do Not Program
  # N
  # VDD Nominal (Applicable only for MPLAB PM3)
  # Device Specific
  # OA<Type><Value>
  # Type:
  # A = PGC resistor value in Kohms
  #
  # None
  # B = PGD resistor value in Kohms
  # None
  # C = PGC Configuration (0=None, 1=Pull up, 2=Pull down)
  # None
  # D = PGD Configuration (0=None, 1=Pull up, 2=Pull down)
  # None
  # L = LED Brightness (1 to 10)
  # 1
  # S = Programming Speed (0=Minimum, 1=Medium, 2=Maximum)
  # 2
  # OB
  # Batch Mode Operation
  # None
  # OC<memory region>
  # Select Memory Regions (Applicable with Programmer-to-go)
  # P = Program memory
  # E = EEPROM
  # I = ID memory
  # C = Configuration memory
  # All Regions Selected
  # OD
  # VDD First (Applicable for PICKIT 3 and MPLAB ICD 3)
  # VPP First
  # OE
  # Description File for Saving Environment
  # None
  # OG<imagename>
  # PICKIT 3 Programmer-to-go (Applicable only for PICKIT 3)
  # None
  # OH
  # Erase All Before Program (Not Selected)
  # Selected
  # OI
  # Display Device ID Revision (Applicable only for MPLAB PM3)
  # Do Not Display
  # OJ
  # JTAG interface used for Program, Read, Erase, Verify, and Blank check operations. (Applicable only for MPLAB REAL ICE and PIC32MZ, MX,WK device families)
  # None
  # OL
  # Release From Reset (Not Applicable for MPLAB PM3)
  # Hold in reset
  # OM
  # Miscellaneous File for Saving Environment.
  # None
  # ON####,####
  # Program Memory Range
  # #### is a hexadecimal number representing Start and End Address in sequence
  # None
  # OP<range>
  # Preserve Program Memory
  # Example OP0-1FF
  # Do Not Preserve
  # OR<Setting><Value>
  # AVR/SAM related Setting
  # OR<Setting><Value>
  # OT
  # Applicable for read and verification operations only. To be used only if the device is configured to work in dual-partition mode.
  # Multi-partition device
  # OU
  # Overwrite Calibration Memory
  # Do Not Overwrite
  # P<part>
  # Part Selection. Example: 16F877
  # None
  # Q
  # Quiet Mode, no screen output (Applicable only for MPLAB PM3)
  # Quiet mode off
  # R<on><off>
  # Safe/Restricted mode (Applicable only for MPLAB PM3)
  # None
  # S<file>
  # SQTP File Selection
  # None
  # T
  # P = Tool Selection E.g. –TPRICE for MPLAB REAL ICE –TPPK3 for PICKIT 3
  # S = Specific Tool Selection using Serial No, E.g. TSBUR1234566
  # Short Name for Tools:
  # MPLAB REAL ICE   –  RICE
  # MPLAB ICD 4    -  ICD4
  # MPLAB ICD 3        –  ICD3
  # MPLAB PICkit 4   –  PK4
  # MPLAB Snap -- SNAP
  # PICKIT 3   –  PK3
  # MPLAB PM3         –  PM3
  # PKOB    -  PKOB
  # None
  # V
  # VPP (Applicable only for MPLAB PM3)
  # Device Specific
  # W
  # Power target from tool
  # Externally Power Target
  # X
  # VDD Max (Applicable only for MPLAB PM3)
  # Device Specific
  # Y<memory region>
  # Verify Device
  # P = Program memory
  # E = EEPROM
  # I = ID memory
  # C = Configuration memory
  # B = Boot memory
  # A = Auxiliary memory
  # If no region is entered, the entire device will be verified.
  # Do Not Verify
  # Z
  # Preserve EEData on Program
  # Do Not Preserve
  for (N = 1) {
    $"standard output_2" <- ""
    Property Node(instance in=reference to "Square LED", "Visible"=TRUE)
    $"Square LED" <- TRUE
    Concatenate Strings("cmd /c ipeCMD /P", $"PIC ID", " /TPPK") -> w1
    call "SelectProgrammer.gvi"(Programmer=$Programmer) -> (Output=w2)
    call "SupplyPowerToDUT.gvi"(Supply Power to DUT=$"Supply Power to DUT") -> (string {0}=w3)
    Path To String(path=$"Choose Hex File") -> (string=w4)
    Concatenate Strings(w1, w2, w3, " -F\"", w4, "\"", " -M-P") -> w5
    Concatenate Strings("v", $ipeVersion, "\\mplab_platform\\mplab_ipe") -> w6
    Build Path(base path=path "C:\\Program Files (x86)\\Microchip\\MPLABX", name or relative path=w6) -> (appended path=w7)
    call "System Exec.gvi"(run minimized?=TRUE, command line=w5, working directory=w7, wait until completion?=TRUE) -> (standard output=w8)
    $"standard output_2" <- w8
    stop if $stop
  }
  $Output <- $Error
