vi "ReadNewReportID.gvi"   [LabVIEW NXG 4.0.0]
# This Vi is used to assign unique report ID numbers to all reports uploaded through this test environment going forward.
outputs:
  "Report ID Number allocated": string
panel indicators:
  "All Available Report ID Numbers": i64[][]
  "subarray": i64[]
  "array with subset deleted": i64[]
  "Used Report ID Numbers": i64[][]
  "number": u32
  "number_2": u32
  "number_3": u32
  "number_4": u32
  "Report Number to Write": u32[]
uses:
  NI::G Core::File IO (General)::Read Delimited Spreadsheet (I64).gvi
  NI::G Core::File IO (General)::Write Delimited Spreadsheet (1D I64).gvi
diagram:
  w1 = path "\\ei-data1\\Global\\Joe Daly\\600seriesLabviewLink\\TestReportDatabase.csv"
  call "Read Delimited Spreadsheet (I64).gvi"(file=w1) -> (all rows=w2)
  $"All Available Report ID Numbers" <- w2
  Array Index(array=w2) -> (out0[_, 0]=w3)
  $subarray <- w3
  Reverse 1D Array(array=w3) -> (reversed array=w4)
  Delete From Array(inArray=w4, length (1)=1) -> (outArray=w5, deleted=w6)
  $"array with subset deleted" <- w5
  Array Index(array=w6) -> (out0[_]=w7)
  Is Greater Than 0(x=w7)
  Reverse 1D Array(array=w5) -> (reversed array=w8)
  call "Write Delimited Spreadsheet (1D I64).gvi"(file=w1, 1D data=w8, format="%8d")
  Number To Hexadecimal String(number=w7, width (-)=8) -> (hex integer string=w9)
  Concatenate Strings(w9, "\r\n")
  w10 = path "\\ei-data1\\Global\\Joe Daly\\600seriesLabviewLink\\Used Report numbers.csv"
  call "Write Delimited Spreadsheet (1D I64).gvi"(file=w10, 1D data=w6, append to file=TRUE) -> (new file=w11, error out=w12)
  call "Read Delimited Spreadsheet (I64).gvi"(file=w11, error in=w12) -> (all rows=w13)
  $"Used Report ID Numbers" <- w13
  $"Report ID Number allocated" <- w9
  String Subset(length (rest)=2, string=w9) -> w14
  Hexadecimal String To Number(string=w14) -> (number=w15)
  $number <- w15
  String Subset(length (rest)=2, offset (0)=2, string=w9) -> w16
  Hexadecimal String To Number(string=w16) -> (number=w17)
  String Subset(length (rest)=2, offset (0)=4, string=w9) -> w18
  Hexadecimal String To Number(string=w18) -> (number=w19)
  String Subset(length (rest)=2, offset (0)=6, string=w9) -> w20
  Hexadecimal String To Number(string=w20) -> (number=w21)
  Build Array(w15, w17, w19, w21) -> w22
  $"Report Number to Write" <- w22
  $number_2 <- w17
  $number_3 <- w19
  $number_4 <- w21
