vi "ReadNewSerialNumber.gvi"   [LabVIEW NXG 4.0.0]
outputs:
  "Serial Number to Write": u32[]
panel indicators:
  "All Available Serial Numbers": i64[][]
  "subarray": i64[]
  "array with subset deleted": i64[]
  "Serial Number allocated": string
  "Used Serial Numbers": i64[][]
  "number": u32
  "number_2": u32
  "number_3": u32
  "number_4": u32
uses:
  NI::G Core::File IO (General)::Read Delimited Spreadsheet (I64).gvi
  NI::G Core::File IO (General)::Write Delimited Spreadsheet (1D I64).gvi
diagram:
  w1 = path "\\ei-data1\\Global\\Joe Daly\\600seriesLabviewLink\\Test10.csv"
  call "Read Delimited Spreadsheet (I64).gvi"(file=w1) -> (all rows=w2)
  $"All Available Serial Numbers" <- w2
  Array Index(array=w2) -> (out0[_, 0]=w3)
  $subarray <- w3
  Reverse 1D Array(array=w3) -> (reversed array=w4)
  Delete From Array(inArray=w4, length (1)=1) -> (outArray=w5, deleted=w6)
  $"array with subset deleted" <- w5
  Array Index(array=w6) -> (out0[_]=w7)
  Is Greater Than 0(x=w7)
  w8 = path "\\ei-data1\\Global\\Joe Daly\\600seriesLabviewLink\\Test10.csv"
  Reverse 1D Array(array=w5) -> (reversed array=w9)
  call "Write Delimited Spreadsheet (1D I64).gvi"(file=w8, 1D data=w9, format="%8d")
  Number To Hexadecimal String(number=w7, width (-)=8) -> (hex integer string=w10)
  Concatenate Strings(w10, "\r\n")
  w11 = path "\\ei-data1\\Global\\Joe Daly\\600seriesLabviewLink\\Used Serial numbers.csv"
  call "Write Delimited Spreadsheet (1D I64).gvi"(file=w11, 1D data=w6, append to file=TRUE) -> (new file=w12, error out=w13)
  call "Read Delimited Spreadsheet (I64).gvi"(file=w12, error in=w13) -> (all rows=w14)
  $"Used Serial Numbers" <- w14
  $"Serial Number allocated" <- w10
  String Subset(length (rest)=2, string=w10) -> w15
  Hexadecimal String To Number(string=w15) -> (number=w16)
  $number <- w16
  String Subset(length (rest)=2, offset (0)=2, string=w10) -> w17
  Hexadecimal String To Number(string=w17) -> (number=w18)
  String Subset(length (rest)=2, offset (0)=4, string=w10) -> w19
  Hexadecimal String To Number(string=w19) -> (number=w20)
  String Subset(length (rest)=2, offset (0)=6, string=w10) -> w21
  Hexadecimal String To Number(string=w21) -> (number=w22)
  Build Array(w16, w18, w20, w22) -> w23
  $"Serial Number to Write" <- w23
  $number_2 <- w18
  $number_3 <- w20
  $number_4 <- w22
