vi "ReadSerialNumber.gvi"   [LabVIEW NXG 4.0.0]
# Generic read of serial number for any Ei products with UART enabled.
inputs:
  "session reference": "VISA Instr"
  "error in": error
outputs:
  "error out": error
  "Serial Number": u8[]
  "session out": "VISA Instr"
uses:
  600SeriesTestEnvironment::CRC.gvi
  NI::VISA::Write (Instr, Bytes).gvi
  NI::VISA::Read (Instr, Bytes).gvi
diagram:
  Array Subset(array=[0, 85, 5, 62, 240, 8], index0=3) -> w1
  call "CRC.gvi"(Input for CRC Calculation=w1) -> (MSB=w2, LSB=w3)
  Build Array([0, 85, 5, 62, 240, 8], w2, w3) -> w4
  call "Write (Instr, Bytes).gvi"(session in=$"session reference", error in=$"error in", write buffer=w4) -> (session out=w5, error out=w6)
  for (N = 1) {
    Wait(time to wait=1000)
  }
  Property Node(instance in=w5, error in=w6) -> ("ASRL Bytes at Port"=w7, error out=w8, instance out=w9)
  call "Read (Instr, Bytes).gvi"(session in=w9, error in=w8, byte count=w7) -> (session out=w10, error out=w11, read buffer=w12)
  $"session out" <- w10
  $"error out" <- w11
  Array Subset(array=w12, index0=10, length0=4) -> w13
  $"Serial Number" <- w13
