vi "ResetSerial.gvi"   [LabVIEW NXG 4.0.0]
inputs:
  "resource name": "VISA Instr" = "COM25"
  "error in": error
outputs:
  "error out_4": error
  "session out": "VISA Instr"
  "EEPROM Read response": u8[]
  "Bytes at Port": u32
uses:
  NI::VISA::Open (Instr).gvi
  NI::VISA::Configure Serial Port (Instr).gvi
  NI::VISA::Flush Buffer (Instr).gvi
  NI::VISA::Write (Instr, Bytes).gvi
  NI::VISA::Read (Instr, Bytes).gvi
diagram:
  call "Open (Instr).gvi"(resource name=$"resource name", error in=$"error in") -> (session out=w1, error out=w2)
  call "Configure Serial Port (Instr).gvi"(session in=w1, error in=w2, baud rate=19200, enable termination char=FALSE) -> (session out=w3, error out=w4)
  call "Flush Buffer (Instr).gvi"(session in=w3, error in=w4, mode="Discard Receive and Transmit Buffers"(192)) -> (session out=w5, error out=w6)
  call "Write (Instr, Bytes).gvi"(session in=w5, error in=w6, write buffer=[0, 85, 9, 60, 244, 4, 0, 0, 0, 0, 228, 51]) -> (session out=w7, error out=w8)
  for (N = 1) {
    Wait(time to wait=1000)
  }
  Property Node(instance in=w7, error in=w8) -> ("ASRL Bytes at Port"=w9, error out=w10, instance out=w11)
  call "Read (Instr, Bytes).gvi"(session in=w11, error in=w10, byte count=w9) -> (session out=w12, error out=w13, read buffer=w14)
  $"session out" <- w12
  $"error out_4" <- w13
  $"EEPROM Read response" <- w14
  $"Bytes at Port" <- w9
