vi "SendCommandNoResponse.gvi"   [LabVIEW NXG 4.0.0]
inputs:
  "cluster in": T1
  "Test Code": string = "62"
outputs:
  "error out_3": error
types:
  T1 = cluster{"VISA In": "VISA Instr", "Error in": error, "RF Serial to match": string, "Ext Mes to Ser No": string}
uses:
  NI::VISA::Open (Instr).gvi
  NI::VISA::Configure Serial Port (Instr).gvi
  NI::VISA::Flush Buffer (Instr).gvi
  NI::VISA::Write (Instr, String).gvi
diagram:
  # w1: Ext Mes to Ser No
  # Error In
  Property Node(instance in=$"cluster in") -> ("VISA In"=w2, "Error in"=w3, "Ext Mes to Ser No"=w1)
  Concatenate Strings(w1, "CD", ",", $"Test Code", "\r", "\r\n") -> w4
  # VISA IN
  # w3: Error In
  call "Open (Instr).gvi"(resource name=w2, error in=w3) -> (session out=w5, error out=w6)
  call "Configure Serial Port (Instr).gvi"(stop bits="1.0"(10), flow control="None"(0), session in=w5, error in=w6, baud rate=115200, data bits=8, parity="None"(0), timeout=10000, termination char=10, enable termination char=FALSE) -> (session out=w7, error out=w8)
  # w9: VISA In
  call "Flush Buffer (Instr).gvi"(session in=w7, error in=w8, mode="Discard Receive and Transmit Buffers"(192)) -> (session out=w9, error out=w10)
  call "Write (Instr, String).gvi"(session in=w9, error in=w10, write buffer=w4) -> (session out=w11, error out=w12)
  call "Flush Buffer (Instr).gvi"(session in=w11, error in=w12, mode="Discard Receive and Transmit Buffers"(192)) -> (error out=w13)
  $"error out_3" <- w13
