vi "SendCommandReceiveResponse.gvi"   [LabVIEW NXG 4.0.0]
inputs:
  "cluster in": T1
  "Test Code": string = "38"
outputs:
  "Response HEX": string
  "Response": string
  "Ready to Send": bool
  "error out": error
types:
  T1 = cluster{"VISA in": "VISA Instr", "Error in": error, "RF Serial to Match": string, "Ext Mes to Ser No": string}
uses:
  NI::VISA::Open (Instr).gvi
  NI::VISA::Configure Serial Port (Instr).gvi
  NI::VISA::Flush Buffer (Instr).gvi
diagram:
  # w1: VISA IN
  # w2: Ext Mes to Ser No.
  Property Node(instance in=$"cluster in") -> ("VISA in"=w1, "Error in"=w3, "RF Serial to Match"=w4, "Ext Mes to Ser No"=w2)
  # w4: RF Serial To Match
  Concatenate Strings(w2, "CE", ",", $"Test Code", "\r", "\r\n") -> w5
  # w3: Error In
  call "Open (Instr).gvi"(resource name=w1, error in=w3) -> (session out=w6, error out=w7)
  call "Configure Serial Port (Instr).gvi"(stop bits="1.0"(10), flow control="None"(0), session in=w6, error in=w7, baud rate=115200, data bits=8, parity="None"(0), timeout=10000, termination char=10, enable termination char=FALSE) -> (session out=w8, error out=w9)
  call "Flush Buffer (Instr).gvi"(session in=w8, error in=w9, mode="Discard Receive and Transmit Buffers"(192)) -> (session out=w10, error out=w11)
  call "ExtendedMessageSendReceiveVI.gvi"(VISA IN=w10, RF Input String=w5, No. Bytes Lower Limit=33, Message Type to Match=$"Test Code", RF Serial Number to match=w4, Error_IN=w11) -> (VISA Out=w12, Extended Message Portion=w13, Error_Out=w14)
  call "Flush Buffer (Instr).gvi"(session in=w12, error in=w14, mode="Discard Receive and Transmit Buffers"(192)) -> (error out=w15)
  $"error out" <- w15
  String Subset(length (rest)=2, offset (0)=28, string=w13) -> w16
  $"Response HEX" <- w16
  Hexadecimal String To Number(string=w16) -> (number=w17)
  case (w17) {
    frame 67 {
      w18 = "Entered Correctly"
      w19 = FALSE
    }
    frame 69 {
      w18 = "In Alarm or Test"
      w19 = FALSE
    }
    frame 0, Default {
      w18 = "-"
      w19 = FALSE
    }
    frame 131 {
      w18 = "Exited Correctly"
      w19 = FALSE
    }
    frame 133 {
      w18 = "Was not in Piezo Control Mode"
      w19 = FALSE
    }
    frame 76 {
      w18 = "Unit already in modulation"
      w19 = FALSE
    }
    frame 79 {
      w18 = "10 seconds not elapsed"
      w19 = FALSE
    }
    frame 88 {
      w18 = "Horn Cycle Restarted"
      w19 = FALSE
    }
  }
  $Response <- w18
  $"Ready to Send" <- w19
