vi "SendReceiveRFmessage.gvi"   [LabVIEW NXG 4.0.0]
inputs:
  "Input_2": "VISA Instr"
  "Input_3": string
  "Input": error
outputs:
  "session in": "VISA Instr"
  "string": string
  "ED Message Rx": bool
  "RF Serial Number_2": string
  "x": bool
  "input 1": bool
  "error in": error
panel controls:
  "Input_4": string
uses:
  NI::VISA::Write (Instr, String).gvi
  NI::VISA::Read (Instr, String).gvi
  NI::VISA::Flush Buffer (Instr).gvi
diagram:
  for (N = 3) (iteration -> i1) {
    call "Write (Instr, String).gvi"(session in=$Input_2, error in=$Input, write buffer=$Input_3) -> (session out=w1, error out=w2)
    while (iteration -> i2) {
      Wait(time to wait=150)
      Search Or Split String(search string/char="F0", string=$Input_3) -> (match + rest of string=w3)
      String Subset(length (rest)=11, offset (0)=3, string=w3) -> w4
      Search And Replace String(input string=w4, replace all (F)=TRUE, replace string ("")=" ", search string=",") -> (result string=w5)
      String Subset(length (rest)=11, offset (0)=0, string=w5) -> w6
      # check user ID
      Property Node(instance in=w1, error in=w2) -> ("ASRL Bytes at Port"=w7, error out=w8, instance out=w9)
      Is Greater(x=w7, y=33) -> w10
      call "Read (Instr, String).gvi"(session in=w9, error in=w8, byte count=w7) -> (session out=w11, error out=w12, read buffer=w13)
      case (w10) {
        frame False, Default {
          w14 = ""
          w15 = FALSE
          w16 = FALSE
          w17 = ""
        }
        frame True {
          Search Or Split String(search string/char=w6, string=w13) -> (match + rest of string=w14, substring before match=w18)
          String Subset(length (rest)=11, offset (0)=0, string=w14) -> w17
          Is Equal(x=w17, y=w6) -> w19
          String Subset(length (rest)=2, offset (0)=0, string=w18) -> w20
          Is Equal(x=w20, y="ED") -> w21
          Logical And(w21, w19) -> w15
          w16 = w15
        }
      }
      Is Greater(x=i2, y=50) -> w22
      Logical Or(w15, w22) -> w23
      stop if w23
    }
    Is Equal(x=i1, y=3) -> w24
    stop if w15
  }
  call "Flush Buffer (Instr).gvi"(session in=w11, error in=w12, mode="Discard Receive and Transmit Buffers"(192)) -> (session out=w25, error out=w26)
  $"session in" <- w25
  $"error in" <- w26
  $"ED Message Rx" <- w16
  $"RF Serial Number_2" <- w17
  $string <- w14
  $x <- w15
  $"input 1" <- w24
