vi "Sounder.gvi"   [LabVIEW NXG 4.0.0]
# Performs the standard Ei product Piezo Check.
inputs:
  "session reference": "VISA Instr"
outputs:
  "Output": "VISA Instr"
  "error out": error
  "sounder result": bool
  "element": u8
panel indicators:
  "read buffer": u8[]
uses:
  NI::VISA::Write (Instr, Bytes).gvi
  NI::VISA::Read (Instr, Bytes).gvi
diagram:
  call "Write (Instr, Bytes).gvi"(session in=$"session reference", write buffer=[0, 85, 3, 237, 205, 115]) -> (session out=w1, error out=w2)
  while {
    call "Read (Instr, Bytes).gvi"(session in=w1, error in=w2, byte count=8) -> (session out=w3, error out=w4, read buffer=w5)
    $"error out" <- w4
    $"read buffer" <- w5
    Array Index(array=w5) -> (out0[4]=w6)
    Is Not Equal To 0(x=w6) -> w7
    Array Index(array=w5) -> (out0[5]=w8)
    Is Greater Than 0(x=8) -> w9
    stop if w9
  }
  $Output <- w3
  $"sounder result" <- w7
  $element <- w8
