vi "ValidationReportReader.gvi"   [LabVIEW NXG 4.0.0]
# This Vi is designed to read and display the standard report form developed in Ei.
inputs:
  "Test Report ID": string
outputs:
  "created cluster": T1
  "min value": i64
  "max value": i64
  "error out": error
panel controls:
  "count": i32 = 1000
panel indicators:
  "RawText": string
  "text": string[]
  "size(s)": i32
types:
  T1 = cluster{"Element 1": string, "Element 2": string, "Element 3": string, "Element 4": string, "Element 5": string, "Element 6": string, "Element 7": string, "Element 8": string, "Element 9": string, "Element 10": string, "Element 11": string, "Element 12": string, "Element 13": string, "Element 14": string, "Element 15": string, "Element 16": string, "Element 17": string, "Element 18": string, "Element 19": string, "Element 20": string, "Element 21": string, "Element 22": string, "Element 23": string, "Element 24": string, "Element 25": string, "Element 26": string, "Element 27": string, "Element 28": string, "Element 29": string, "Element 30": string, "Element 31": string, "Element 32": string, "Element 33": string, "Element 34": string, "Element 35": string, "Element 36": string, "Element 37": string, "Element 38": string, "Element 39": string}
uses:
  NI::G Core::File IO (General)::Read Delimited Spreadsheet (I64).gvi
diagram:
  w1 = path "\\ei-data1\\Global\\Joe Daly\\600seriesLabviewLink\\TestReports"
  Build Path(base path=w1, name or relative path=$"Test Report ID") -> (appended path=w2)
  Open Or Create Or Replace File(access (0:read/write)="read-only", file path (use dialog)=w2) -> (error out=w3, refnum out=w4)
  Read From Text File[ConvertEOL=False, ReadLines=True](count=$count, error in=w3, file (use dialog)=w4) -> (error out=w5, text=w6)
  Array Size(array=w6) -> (size(s)=w7)
  $"size(s)" <- w7
  $text <- w6
  Array Index(array=w6) -> (out0[0]=w8, out1[1]=w9, out2[2]=w10, out3[3]=w11, out4[4]=w12, out5[5]=w13, out6[6]=w14, out7[7]=w15, out8[8]=w16, out9[9]=w17, out10[10]=w18, out11[11]=w19, out12[12]=w20, out13[13]=w21, out14[14]=w22, out15[15]=w23, out16[16]=w24, out17[17]=w25, out18[18]=w26, out19[19]=w27, out20[20]=w28, out21[21]=w29, out22[22]=w30, out23[23]=w31, out24[24]=w32, out25[25]=w33, out26[26]=w34, out27[27]=w35, out28[28]=w36, out29[29]=w37, out30[30]=w38, out31[31]=w39, out32[32]=w40, out33[33]=w41, out34[34]=w42, out35[35]=w43, out36[36]=w44, out37[37]=w45, out38[38]=w46)
  Build Cluster(w8, w9, w10, w11, w12, w13, w14, w15, w16, w17, w18, w19, w20, w21, w22, w23, w24, w25, w26, w27, w28, w29, w30, w31, w32, w33, w34, w35, w36, w37, w38, w39, w40, w41, w42, w43, w44, w45, w46) -> w47
  $"created cluster" <- w47
  w48 = path "\\ei-data1\\Global\\Joe Daly\\600seriesLabviewLink\\Used Report numbers.csv"
  call "Read Delimited Spreadsheet (I64).gvi"(file=w48) -> (all rows=w49)
  Array Max And Min(array=w49) -> (max value=w50, min value=w51)
  $"max value" <- w50
  $"min value" <- w51
  $"error out" <- w5
  Property Node(instance in=w5) -> ("code"=w52)
  Is Equal(x=w52, y=7) -> w53
  case (w53) {
    frame False, Default { }
    frame True {
      while {
        One Button Dialog(message="Report Not Found!") -> (true=w54)
        stop if w54
      }
    }
  }
