vi "WriteNewSerialNumber.gvi"   [LabVIEW NXG 4.0.0]
# looks to a preloaded excel file for the next available serial number and writes that to the DUT if it doesnt already have a serial number.
inputs:
  "session in": "VISA Instr"
  "error in": error
  "selector": bool = TRUE
outputs:
  "Output_2": error
  "Output": "VISA Instr"
  "EEPROM Write response": u8[]
panel indicators:
  "appended array": u32[]
uses:
  NI::VISA::Flush Buffer (Instr).gvi
  600SeriesTestEnvironment::ReadNewSerialNumber.gvi
  600SeriesTestEnvironment::CRC.gvi
  NI::VISA::Write (Instr, Bytes).gvi
  NI::VISA::Read (Instr, Bytes).gvi
diagram:
  case ($selector) {
    frame False, Default {
      w1 = $"error in"
      w2 = $"session in"
    }
    frame True {
      call "Flush Buffer (Instr).gvi"(session in=$"session in", error in=$"error in", mode="Discard Receive and Transmit Buffers"(192)) -> (session out=w3, error out=w4)
      call "ReadNewSerialNumber.gvi"() -> (Serial Number to Write=w5)
      Build Array([0, 85, 9, 60, 244, 4], w5) -> w6
      Array Subset(array=w6, index0=3) -> w7
      call "CRC.gvi"(Input for CRC Calculation=w7) -> (MSB=w8, LSB=w9)
      Build Array(w6, w8, w9) -> w10
      call "Write (Instr, Bytes).gvi"(session in=w3, error in=w4, write buffer=w10) -> (session out=w11, error out=w12)
      for (N = 1) {
        Wait(time to wait=2000)
      }
      Property Node(instance in=w11, error in=w12) -> ("ASRL Bytes at Port"=w13, error out=w14, instance out=w15)
      call "Read (Instr, Bytes).gvi"(session in=w15, error in=w14, byte count=w13) -> (session out=w2, error out=w1, read buffer=w16)
      $"EEPROM Write response" <- w16
      $"appended array" <- w10
    }
  }
  $Output <- w2
  $Output_2 <- w1
