vi "WriteTestValues.gvi"   [LabVIEW NXG 4.0.0]
inputs:
  "Input": "VISA Instr"
  "appended array_2": i64[]
  "Input_2": error
outputs:
  "Output_4": bool
  "Output_3": "VISA Instr"
  "Output_2": error
uses:
  NI::VISA::Flush Buffer (Instr).gvi
  NI::VISA::Write (Instr, Bytes).gvi
  NI::VISA::Read (Instr, Bytes).gvi
diagram:
  for (N = 3) (iteration -> i1) {
    Is Equal(x=i1, y=3) -> w1
    call "Flush Buffer (Instr).gvi"(session in=$Input, error in=$Input_2, mode="Discard Receive and Transmit Buffers"(192)) -> (session out=w2, error out=w3)
    call "Write (Instr, Bytes).gvi"(session in=w2, error in=w3, write buffer=$"appended array_2") -> (session out=w4, error out=w5)
    for (N = 1) {
      Property Node(instance in=w4, error in=w5) -> ("ASRL Bytes at Port"=w6, error out=w7, instance out=w8)
      Wait(time to wait=1000)
    }
    call "Read (Instr, Bytes).gvi"(session in=w8, error in=w7, byte count=6) -> (session out=w9, error out=w10, read buffer=w11)
    Array Index(array=w11) -> (out0[3]=w12)
    Is Equal(x=w12, y=0xFF) -> w13
    Logical Or(w13, w1) -> w14
    stop if w14
  }
  $Output_2 <- w10
  $Output_4 <- w13
  $Output_3 <- w9
